# Grasshopper definition timber_trusses.gh (Grasshopper 1.0.7)
# plug-ins: Karamba3D, NGon, LunchBox

series = Series(Start=0, Step=1, Count=Slider(10, range=0..10))

# ---- group: Fix this
split_param_bottom = Slider(0.45, range=0.1..0.45)
split_param_diagonal = Slider(0.32, range=0.1..0.45)

# ----
height = Slider(1500, range=0..10000)
span = Slider(5000, range=0..10000)
xz_plane = XZPlane(Origin=Point(0, 0, 0))

# ----
# Internalized list of text data.
w_int = Text(["WW_5_15_300;[[3.416,(73,223)],[2.278,(73,223)],[3.416,(73,223)],[2.278,(73,223)],[2.2,(48,198)],[2.2,(48,198)],[2.2,(48,198)],[2.2,(48,198)],[2.2,(48,198)],[1.139,(36,148)],[1.411,(36,148)],[1.411,(36,148)],[1.839,(36,148)],[1.139,(36,148)],[1.411,(36,148)],[1.411,(36,148)],[1.839,(36,148)]]", "WW_7_15_300;[[4.038,(73,223)],[2.692,(73,223)],[4.038,(73,223)],[2.692,(73,223)],[2.6,(73,198)],[2.6,(73,198)],[2.6,(73,198)],[2.6,(73,198)],[2.6,(73,198)],[1.346,(48,148)],[1.668,(48,148)],[1.668,(48,148)],[2.173,(48,148)],[1.346,(48,148)],[1.668,(48,148)],[1.668,(48,148)],[2.173,(48,148)]]", "WW_9_15_300;[[4.659,(73,223)],[3.106,(73,223)],[4.659,(73,223)],[3.106,(73,223)],[3,(73,223)],[3,(73,223)],[3,(73,223)],[3,(73,223)],[3,(73,223)],[1.553,(61,198)],[1.925,(61,198)],[1.925,(61,198)],[2.508,(61,198)],[1.553,(61,198)],[1.925,(61,198)],[1.925,(61,198)],[2.508,(61,198)]]", "WW_11_15_300;[[5.28,(73,223)],[3.52,(73,223)],[5.28,(73,223)],[3.52,(73,223)],[3.4,(73,223)],[3.4,(73,223)],[3.4,(73,223)],[3.4,(73,223)],[3.4,(73,223)],[1.76,(61,198)],[2.181,(61,198)],[2.181,(61,198)],[2.842,(61,198)],[1.76,(61,198)],[2.181,(61,198)],[2.181,(61,198)],[2.842,(61,198)]]", "WW_13_15_300;[[5.901,(73,223)],[3.934,(73,223)],[5.901,(73,223)],[3.934,(73,223)],[3.8,(73,223)],[3.8,(73,223)],[3.8,(73,223)],[3.8,(73,223)],[3.8,(73,223)],[1.967,(73,198)],[2.438,(73,198)],[2.438,(73,198)],[3.176,(73,198)],[1.967,(73,198)],[2.438,(73,198)],[2.438,(73,198)],[3.176,(73,198)]]", "WW_15_15_300;[[1.596,(36,148)],[1.064,(36,148)],[1.596,(36,148)],[1.064,(36,148)],[1,(36,36)],[1,(36,36)],[1,(36,36)],[1,(36,36)],[1,(36,36)],[0.532,(36,36)],[0.74,(36,36)],[0.74,(36,36)],[1.038,(36,36)],[0.532,(36,36)],[0.74,(36,36)],[0.74,(36,36)],[1.038,(36,36)]]"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])
w_int_2 = Text(["A_5_15_300;[[2.588,(73,198)],[1.734,(73,198)],[0.854,(73,198)],[5,(36,148)],[0.221,(36,148)],[0.221,(36,148)],[1.65,(36,148)]]", "A_7_15_300;[[3.623,(73,223)],[2.428,(73,223)],[1.196,(73,223)],[7,(73,223)],[0.309,(36,198)],[0.309,(36,198)],[2.31,(36,198)]]", "A_9_15_300;[[4.659,(73,223)],[3.121,(73,223)],[1.537,(73,223)],[9,(73,223)],[0.398,(73,223)],[0.398,(73,223)],[2.97,(73,223)]]", "A_11_15_300;[[5.694,(73,223)],[3.815,(73,223)],[1.879,(73,223)],[11,(73,223)],[0.486,(73,223)],[0.486,(73,223)],[3.63,(73,223)]]", "A_13_15_300;[[6.729,(73,223)],[4.509,(73,223)],[2.221,(73,223)],[13,(73,223)],[0.575,(73,223)],[0.575,(73,223)],[4.29,(73,223)]]", "A_15_15_300;[[7.765,(73,223)],[5.202,(73,223)],[2.562,(73,223)],[15,(73,223)],[0.663,(73,223)],[0.663,(73,223)],[4.95,(73,223)]]"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])
w_int_3 = Text(["A-lifted_5_15_300;[[2.588,(73,198)],[1.708,(73,198)],[0.88,(73,198)],[0.85,(36,148)],[3.3,(36,148)],[0.85,(36,148)],[0.25,(36,148)],[0.478,(36,148)],[0.886,(36,148)],[0.25,(36,148)],[0.478,(36,148)],[0.886,(36,148)],[1.7,(36,148)]]", "A-lifted_7_15_300;[[3.623,(73,223)],[2.391,(73,223)],[1.232,(73,223)],[1.19,(36,148)],[4.62,(36,148)],[1.19,(36,148)],[0.35,(36,198)],[0.669,(36,198)],[1.24,(36,198)],[0.35,(36,198)],[0.669,(36,198)],[1.24,(36,198)],[2.38,(36,198)]]", "A-lifted_9_15_300;[[4.659,(73,223)],[3.075,(73,223)],[1.584,(73,223)],[1.53,(61,198)],[5.94,(61,198)],[1.53,(61,198)],[0.45,(73,223)],[0.86,(73,223)],[1.595,(73,223)],[0.45,(73,223)],[0.86,(73,223)],[1.595,(73,223)],[3.06,(73,223)]]", "A-lifted_11_15_300;[[5.694,(73,223)],[3.758,(73,223)],[1.936,(73,223)],[1.87,(73,223)],[7.26,(73,223)],[1.87,(73,223)],[0.55,(73,223)],[1.051,(73,223)],[1.949,(73,223)],[0.55,(73,223)],[1.051,(73,223)],[1.949,(73,223)],[3.74,(73,223)]]", "A-lifted_13_15_300;[[6.729,(73,223)],[4.441,(73,223)],[2.288,(73,223)],[2.21,(73,223)],[8.58,(73,223)],[2.21,(73,223)],[0.65,(73,223)],[1.242,(73,223)],[2.304,(73,223)],[0.65,(73,223)],[1.242,(73,223)],[2.304,(73,223)],[4.42,(73,223)]]", "A-lifted_15_15_300;[[7.765,(73,223)],[5.125,(73,223)],[2.64,(73,223)],[2.55,(73,223)],[9.9,(73,223)],[2.55,(73,223)],[0.75,(73,223)],[1.433,(73,223)],[2.658,(73,223)],[0.75,(73,223)],[1.433,(73,223)],[2.658,(73,223)],[5.1,(73,223)]]"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])
w_int_4 = Text(["W_5_15_300;[[1.165,(36,148)],[1.424,(36,148)],[1.165,(36,148)],[1.424,(36,148)],[1.6,(36,36)],[1.8,(36,36)],[1.6,(36,36)],[0.563,(36,36)],[0.563,(36,36)],[1.122,(36,36)],[1.122,(36,36)]]", "W_7_15_300;[[1.631,(61,198)],[1.993,(61,198)],[1.631,(61,198)],[1.993,(61,198)],[2.24,(36,148)],[2.52,(36,148)],[2.24,(36,148)],[0.788,(36,36)],[0.788,(36,36)],[1.571,(36,36)],[1.571,(36,36)]]", "W_9_15_300;[[2.096,(73,223)],[2.562,(73,223)],[2.096,(73,223)],[2.562,(73,223)],[2.88,(36,148)],[3.24,(36,148)],[2.88,(36,148)],[1.013,(36,48)],[1.013,(36,48)],[2.019,(36,48)],[2.019,(36,48)]]", "W_11_15_300;[[2.562,(73,223)],[3.132,(73,223)],[2.562,(73,223)],[3.132,(73,223)],[3.52,(48,198)],[3.96,(48,198)],[3.52,(48,198)],[1.238,(36,148)],[1.238,(36,148)],[2.468,(36,148)],[2.468,(36,148)]]", "W_13_15_300;[[3.028,(73,223)],[3.701,(73,223)],[3.028,(73,223)],[3.701,(73,223)],[4.16,(61,198)],[4.68,(61,198)],[4.16,(61,198)],[1.463,(48,148)],[1.463,(48,148)],[2.917,(48,148)],[2.917,(48,148)]]", "W_15_15_300;[[3.494,(73,223)],[4.271,(73,223)],[3.494,(73,223)],[4.271,(73,223)],[4.8,(73,223)],[5.4,(73,223)],[4.8,(73,223)],[1.688,(48,148)],[1.688,(48,148)],[3.366,(48,148)],[3.366,(48,148)]]"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])
merge = Merge(Data1=w_int_4, Data2=w_int, Data3=w_int_2, Data4=w_int_3)

# ---- group: Angles series
series_2 = Series(step=Slider(5, range=0..10), end="45", start="15")

# ---- group: Length series
series_3 = Series(step="2", end="20", start="5")

# ---- group: c/c series
series_4 = Series(step="200", end="600", start="300")

# ----
text_split = TextSplit(Text=merge, Separators=";")  # -> simplify(Result)
path_mapper = PathMapper()
flip_matrix = FlipMatrix(Data=text_split)

# ----
# Combination generator
panel = Panel("""W
WW
A
A-lifted""")
cross_reference = CrossReference(ListName=panel, ListA="_", ListLength=series_3, ListB="_", ListAngle=series_2, ListC="_", ListCC=series_4, CrossMode=1)  # -> ListName, ListA, ListLength, ListB, ListAngle, ListC, ListCC
concatenate = Concatenate(
    Fragment_A=cross_reference.ListName,
    C=cross_reference.ListA,
    Fragment_B=cross_reference.ListLength,
    D=cross_reference.ListB,
    A=cross_reference.ListAngle,
    E=cross_reference.ListC,
    B=cross_reference.ListCC)
create_set = CreateSet(List=cross_reference.ListName)  # -> Set, Map
sift_pattern = SiftPattern(List=concatenate, SiftPattern=create_set.Map)  # -> Output0, Output1, Output2, Output3
construct_path = ConstructPath(Indices=graft(create_set.Map))  # -> simplify(Branch)
entwine = Entwine(
    Branch00=sift_pattern.Output0,
    Branch01=sift_pattern.Output1,
    Branch02=sift_pattern.Output2,
    Branch03=sift_pattern.Output3,
    FlattenInputs=True)
clean_tree = CleanTree(RemoveNulls=True, RemoveInvalid=True, RemoveEmpty=False, Tree=entwine)
explode_tree = ExplodeTree(Data=clean_tree)  # -> Branch0, Branch1, Branch2, Branch3

list_item = ListItem(List=flatten(explode_tree.Branch0), Index=series, Wrap=True)

# ----
# A-roof
number_slider = Slider(0.33, range=0.05..0.5)
ghpython_script = GhPythonScript(truss_names=explode_tree.Branch2)  # -> out, types, lengths, angles, center_dists; inputs truss_names: list
# ---------- ghpython_script: Python ----------
__author__ = "sverremh"
__version__ = "2023.01.10"

import rhinoscriptsyntax as rs

types = []
lengths = []
angles = []
center_dists = []
for el in truss_names:
    sub = el.split('_')
    types.append(sub[0])
    lengths.append(sub[1])
    angles.append(sub[2])
    center_dists.append(sub[3])
# ---------- end ghpython_script ----------
point = Point(Point(5433.532643, -93.11039246, 0))
xz_plane_2 = XZPlane(Origin=point)
cluster = Cluster(plane=xz_plane_2, number_2=ghpython_script.lengths, degrees=ghpython_script.angles, number=number_slider)  # -> line_9, line_8, curve_2
width = Panel("48")
height_2 = Panel("98")
width_2 = Panel("98")
height_3 = Panel("48")
width_3 = Panel("48")
height_4 = Panel("48")
beam_from_line = BeamFromLine(curve=cluster.curve_2, domain_start_2=height_3, domain_start=width_2)
beam_from_line_2 = BeamFromLine(curve=cluster.line_9, domain_start_2=height_2, domain_start=width)
beam_from_line_3 = BeamFromLine(curve=cluster.line_8, domain_start_2=height_4, domain_start=width_3)

# ----
# W-truss
ghpython_script_2 = GhPythonScript(truss_names=explode_tree.Branch0)  # -> out, types, lengths, angles, center_dists; inputs truss_names: list; same code as ghpython_script
w_roof_truss = WRoofTruss(
    plane=xz_plane,
    amplitude=ghpython_script_2.lengths,
    degrees=ghpython_script_2.angles,
    parameter=split_param_bottom,
    parameter_2=split_param_diagonal)  # -> line_9, line_8, curve_2
curve = Curve(w_roof_truss.line_9)
width_4 = Panel("48")
height_5 = Panel("98")
width_5 = Panel("98")
height_6 = Panel("48")
width_6 = Panel("48")
height_7 = Panel("48")
beam_from_line_4 = BeamFromLine(curve=w_roof_truss.line_8, domain_start_2=height_7, domain_start=width_6)
beam_from_line_5 = BeamFromLine(curve=w_roof_truss.curve_2, domain_start_2=height_6, domain_start=width_5)
beam_from_line_6 = BeamFromLine(curve=curve, domain_start_2=height_5, domain_start=width_4)

create_csv = CreateCSV(Delimiter=";")
panel_2 = Panel(text_split)

# ----
# WW-truss
point_2 = Point(Point(-5739.609132, -93.11039246, 0))
ghpython_script_3 = GhPythonScript(truss_names=explode_tree.Branch1)  # -> out, types, lengths, angles, center_dists; inputs truss_names: list; same code as ghpython_script
xz_plane_3 = XZPlane(Origin=point_2)
ww_roof = WWRoof(plane=xz_plane_3, length=ghpython_script_3.lengths, degrees=ghpython_script_3.angles)  # -> line_7, line_6, curve_2
width_7 = Panel("48")
height_8 = Panel("98")
width_8 = Panel("98")
height_9 = Panel("48")
width_9 = Panel("48")
height_10 = Panel("48")
beam_from_line_7 = BeamFromLine(curve=ww_roof.curve_2, domain_start_2=height_9, domain_start=width_8)
beam_from_line_8 = BeamFromLine(curve=ww_roof.line_6, domain_start_2=height_10, domain_start=width_9)
beam_from_line_9 = BeamFromLine(curve=ww_roof.line_7, domain_start_2=height_8, domain_start=width_7)

rafter_height_factor = Panel("0.05")

# ----
# Something that does not work perfectly in this cluster. The right vertical seem to be missing/unconnected with the rest of the model.
# A-roof-lifted.
number_slider_2 = Slider(0.34, range=0.05..0.5)
angle = ValueList({"10", "15", "25", "35", "45", "60"}, selected="45")
ghpython_script_4 = GhPythonScript(truss_names=explode_tree.Branch3)  # -> out, types, lengths, angles, center_dists; inputs truss_names: list; same code as ghpython_script
point_3 = Point(Point(10892.40848, -93.11039246, 0))
xz_plane_4 = XZPlane(Origin=point_3)
cluster_2 = Cluster_2(
    plane=xz_plane_4,
    lenghts=ghpython_script_4.lengths,
    degrees=ghpython_script_4.angles,
    number=number_slider_2,
    lift_factor=rafter_height_factor)  # -> line_10, line_9, curve_2
width_10 = Panel("48")
height_11 = Panel("98")
width_11 = Panel("98")
height_12 = Panel("48")
width_12 = Panel("48")
height_13 = Panel("48")
beam_from_line_10 = BeamFromLine(curve=cluster_2.curve_2, domain_start_2=height_12, domain_start=width_11)
beam_from_line_11 = BeamFromLine(curve=cluster_2.line_10, domain_start_2=height_11, domain_start=width_10)
beam_from_line_12 = BeamFromLine(curve=cluster_2.line_9, domain_start_2=height_13, domain_start=width_12)

panel_3 = Panel(explode_tree.Branch1)
analyze_karamba3d = AnalyzeKaramba3D()  # -> CalculatedModel, MaximumDisplacement_cm, ResultingForce_kN, ChangeOfElasticEnergy_kNm
value_list = ValueList({"W": 0, "WW": 1, "A": 2, "A lifted": 3}, selected="A lifted")
data_dam = DataDam(DataDataA=value_list, BufferDelay=10000000, BufferMode=0)

# ---- group: Tops
stream_filter = StreamFilter(Gate=data_dam, Stream0=w_roof_truss.line_9, Stream1=ww_roof.line_7, Stream2=cluster.line_9, Stream3=cluster_2.line_10)

# ---- group: Diagonals
stream_filter_2 = StreamFilter(Gate=data_dam, Stream0=w_roof_truss.line_8, Stream1=ww_roof.line_6, Stream2=cluster.line_8, Stream3=cluster_2.line_9)

# ---- group: Bottoms
stream_filter_3 = StreamFilter(Gate=data_dam, Stream0=w_roof_truss.curve_2, Stream1=ww_roof.curve_2, Stream2=cluster.curve_2, Stream3=cluster_2.curve_2)

# ---- group: Diags
curve_2 = Curve(simplify(stream_filter_2))

# ---- group: Top
curve_3 = Curve(simplify(stream_filter))

# ---- group: Bottom
# Input curves Karamba
curve_4 = Curve(simplify(stream_filter_3))

# ----
end_points = EndPoints(Curve=curve_2)  # -> Start, End

# ----
# Load definition
stream_filter_4 = StreamFilter(
    Gate=data_dam,
    Stream0=ghpython_script_2.center_dists,
    Stream1=ghpython_script_3.center_dists,
    Stream2=ghpython_script.center_dists,
    Stream3=ghpython_script_4.center_dists)
division = Division(A=stream_filter_4, B=1000)
unit_z = UnitZ(Factor=expr("-x", "2"))
match_all_top_elements = Panel("&Top.")
multiplication = Multiplication(A=unit_z, B=division)
unit_z_2 = UnitZ(Factor=expr("-x", Slider(52, range=0..100)))
beam_loads_karamba3d = BeamLoadsKaramba3D(
    BeamIdentifier=match_all_top_elements,
    LoadCase="LC0",
    ForceVector=multiplication,
    TStart=0,
    TEnd=1,
    mode="Block",
    menu=[buttons(off, off, on)])  # -> simplify(Load)
loads_karamba3d = LoadsKaramba3D(Vector=unit_z_2, LCase="LC0", mode="Gravity")
list_length = ListLength(List=multiplication)
repeat_data = RepeatData(Data=loads_karamba3d, Length=list_length)  # -> simplify(graft(Data))

# ----
# Support points
end_points_2 = EndPoints(Curve=curve_4)  # -> Start, End
point_4 = Point(end_points_2.Start)
point_5 = Point(end_points_2.End)
support_karamba3d = SupportKaramba3D(PosInd=point_4, menu=[buttons(on, on, on, on, off, on)])
support_karamba3d_2 = SupportKaramba3D(PosInd=point_5, menu=[buttons(off, on, on, on, off, on)])

curveshatter = CurveShatter(Curve=curve_3, Points=end_points.End, Tolerance=0.01)
curveshatter_2 = CurveShatter(Curve=curve_4, Points=end_points.Start, Tolerance=0.01)  # -> simplify(Curves)
cluster_3 = Cluster_3(tree=curve_2, second_lvl_index="2")
cluster_4 = Cluster_3(tree=curveshatter_2, second_lvl_index="1")
insert_path_level = InsertPathLevel(tree=curveshatter)

# ----
# Name beams 2.0
line = Line(insert_path_level)
line_2 = Line(cluster_3)
line_3 = Line(cluster_4)
tree_statistics = TreeStatistics(Tree=line)  # -> Paths, Length, Count
tree_statistics_2 = TreeStatistics(Tree=line_2)  # -> Paths, Length, Count
tree_statistics_3 = TreeStatistics(Tree=line_3)  # -> Paths, Length, Count
deconstruct_path = DeconstructPath(Branch=tree_statistics.Paths)
deconstruct_path_2 = DeconstructPath(Branch=tree_statistics_2.Paths)
deconstruct_path_3 = DeconstructPath(Branch=tree_statistics_3.Paths)
list_item_2 = ListItem(List=deconstruct_path, Index=-1, Wrap=True)  # -> simplify(Item)
series_5 = Series(Start=0, Step=1, Count=tree_statistics_3.Length)
series_6 = Series(Start=0, Step=1, Count=tree_statistics_2.Length)
list_item_3 = ListItem(List=deconstruct_path_2, Index=-1, Wrap=True)  # -> simplify(Item)
list_item_4 = ListItem(List=deconstruct_path_3, Index=-1, Wrap=True)  # -> simplify(Item)
concatenate_2 = Concatenate(FragmentA="Top", FragmentB=list_item_2)
concatenate_3 = Concatenate(FragmentA="Diag", FragmentB=series_6)
concatenate_4 = Concatenate(FragmentA="Bottom", FragmentB=list_item_4)
match_tree = MatchTree(Tree=concatenate_2, Guide=line)
match_tree_2 = MatchTree(Tree=concatenate_3, Guide=line_2)
match_tree_3 = MatchTree(Tree=concatenate_4, Guide=line_3)
merge_2 = Merge(Data1=match_tree, Data2=match_tree_2, Data3=match_tree_3)
panel_4 = Panel(merge_2)

merge_3 = Merge(Data1=insert_path_level, Data2=cluster_4, Data3=cluster_3)
shift_paths = ShiftPaths(Data=curveshatter, Offset=expr("-x", 1))
timber_cross_section = TimberCrossSection()
panel_5 = Panel("""&Top.
&Bottom.
&Diag.""")
panel_6 = Panel("""Tops
Bottoms
Diagonals""")
list_item_5 = ListItem(List=timber_cross_section, Index=0, Wrap=True)
line_to_beam_karamba3d = LineToBeamKaramba3D(
    Line=simplify(merge_3),
    Identifier=simplify(merge_2),
    CrossSection=list_item_5,
    New=True,
    Remove=True,
    LimitDistance_m=0.005,
    Bending=True,
    SetBucklingLength=True,
    ToPolylineMaxAngle=0.03,
    ToPolylineTolerance=0.01,
    ToPolylineMaxEdgeLength=0.25)  # -> simplify(Element), Points, Info
make_element_set_karamba3d = MakeElementSetKaramba3D(ElementIdentifiers=graft(panel_5), SetIdentifier=graft(panel_6), MinimumSplitLength_m=0.001)  # -> flatten(ElementSet)
element_karamba3d = ElementKaramba3D(line_to_beam_karamba3d.Element)
panel_7 = Panel(list_item_5)
tree_statistics_4 = TreeStatistics(Tree=element_karamba3d)  # -> Paths, Length, Count
trim_tree = TrimTree(Tree=element_karamba3d, Depth=2)
deconstruct_path_4 = DeconstructPath(Branch=tree_statistics_4.Paths)
list_item_6 = ListItem(List=deconstruct_path_4, Index=0, Wrap=True)
settings_karamba3d = SettingsKaramba3D(menu=[dropdown(0)])  # -> AllSettings, GenericOutput
construct_path_2 = ConstructPath(Indices=list_item_6)  # -> flatten(Branch)
replace_paths = ReplacePaths(Data=element_karamba3d, Search=tree_statistics_4.Paths, Replace=construct_path_2)
support_karamba3d_3 = SupportKaramba3D([support_karamba3d_2, support_karamba3d])
load_karamba3d = LoadKaramba3D([repeat_data, beam_loads_karamba3d])
panel_8 = Panel(match_tree)
assemble_model_karamba3d = AssembleModelKaramba3D(
    Elem=replace_paths,
    Support=support_karamba3d_3,
    Load=load_karamba3d,
    BeamSet=make_element_set_karamba3d,
    LimitDistance_m=0.0001)  # -> Model, Info, Mass_kg, CenterOfGravity, LoadCaseNames
panel_9 = Panel(assemble_model_karamba3d.Mass_kg)
analyze_karamba3d_2 = AnalyzeKaramba3D(Model=assemble_model_karamba3d.Model)  # -> CalculatedModel, MaximumDisplacement_cm, ResultingForce_kN, ChangeOfElasticEnergy_kNm

# ---- group: Available Cross sections
cross_section_karamba3d = CrossSectionKaramba3D(timber_cross_section)

# ----
optimize_cross_section_karamba3d = OptimizeCrossSectionKaramba3D(
    Model=analyze_karamba3d_2.CalculatedModel,
    GroupIdentifiers=panel_6,
    CrossSections=cross_section_karamba3d,
    MaximumUtilization=0.95,
    UltimateLimitStateIterations=5,
    DisplacementIterations=5,
    NumberOfSamplePoints=4,
    ElasticDesign=True,
    GammaM0=1,
    GammaM1=1.1,
    SwayFrame=True)  # -> ModelWithOptimizedCrossSections, Info, Mass_kg, MaximumDisplacement_cm, ElasticEnergyChange_kNm
ghpython_script_5 = GhPythonScript(text="[(200,36,48),(250,36,36),(240,36,36),(500,36,36)]")  # -> out, a
# ---------- ghpython_script_5: Python ----------
__author__ = "sverremh"
__version__ = "2023.01.06"

import rhinoscriptsyntax as rs
from ast import literal_eval

a = literal_eval(text)
# ---------- end ghpython_script_5 ----------
ghpython_script_6 = GhPythonScript(text=ghpython_script_5.a)  # -> out, a; same code as ghpython_script_5
panel_10 = Panel(ghpython_script_5.a)
model_view_karamba3d = ModelViewKaramba3D(Model=optimize_cross_section_karamba3d.ModelWithOptimizedCrossSections)  # -> Model, DeformedMesh, DeformedAxes, DeformedModel, MaximumDeformation
panel_11 = Panel(ghpython_script_6.a)
beam_view_karamba3d = BeamViewKaramba3D(Model=model_view_karamba3d.Model)  # -> Model, MeshesOfRenderedBeams, DeformedBeamAxes, LegendColors, LegendTags
disassemble_model_karamba3d = DisassembleModelKaramba3D(Model=optimize_cross_section_karamba3d.ModelWithOptimizedCrossSections)  # -> Model, Point, Beam, Shell, Support, Load, Line, Mesh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
disassemble_element_karamba3d = DisassembleElementKaramba3D(Element=disassemble_model_karamba3d.Beam)  # -> Element, ElementIdentifier, AxisOfElement, CrossSection, Joint, Material, LocalCoordinateSystem, ElementIsActive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
disassemble_cross_section_karamba3d = DisassembleCrossSectionKaramba3D(CroSec=disassemble_element_karamba3d.CrossSection)  # -> CrossSection, FamilyNameOfCrossSection, TypeNameOfCrossSection, ElemIdentifiers, Color, Material, LocalEccentricity_cm, Heights_cm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

stream_filter_5 = StreamFilter(
    Gate=data_dam,
    Stream0=explode_tree.Branch0,
    Stream1=explode_tree.Branch1,
    Stream2=explode_tree.Branch2,
    Stream3=explode_tree.Branch3)

# ---- group: Element lentgth
number = Number(expr("round(x,3)", disassemble_element_karamba3d.AxisOfElement))

# ---- group: Element names
text = Text(stream_filter_5)

# ----
ghpython_script_7 = GhPythonScript(lengths=number, cross_sec_types=disassemble_cross_section_karamba3d.TypeNameOfCrossSection)  # -> out, elem_string; inputs lengths: list, cross_sec_types: list
# ---------- ghpython_script_7: Python ----------
__author__ = "sverremh"
__version__ = "2023.01.11"

import rhinoscriptsyntax as rs

elem_list = []

# create sublist of each element on the form [L, (w,h)]
for i in range(len(lengths)):
    cs_lst = cross_sec_types[i].split('x')
    elem_txt = "[" + str(lengths[i]) + "," + "(" + str(cs_lst[0]) + "," + str(cs_lst[1]) + ")]"
    elem_list.append(elem_txt)
    
elem_string = "["
for el in elem_list:
    elem_string += el
    elem_string += ","
elem_string = elem_string[:-1]
elem_string += "]"
# ---------- end ghpython_script_7 ----------
concatenate_5 = Concatenate(Fragment_A=text, Fragment_B=";", A=flatten(ghpython_script_7.elem_string))
concatenate_6 = Concatenate(Fragment_A=number, Fragment_B=",", A=disassemble_cross_section_karamba3d.TypeNameOfCrossSection)
stream_gate = StreamGate(Stream=concatenate_5, Gate=data_dam)  # -> Target0, Target1, Target2, Target3

# ---- group: A-truss lifted
text_2 = Text(stream_gate.Target3)

# ---- group: WW-truss data
text_3 = Text(stream_gate.Target1)

# ---- group: A-truss data
text_4 = Text(stream_gate.Target2)

# ---- group: W-truss data
text_5 = Text(stream_gate.Target0)

# ==== cluster WRoofTruss
degrees = ClusterInput()
radians = Radians(Degrees=degrees)
amplitude = ClusterInput()
plane = ClusterInput()
expression = Expression(l=amplitude, a=radians, Expression="tan(a)*(l/2)")
deconstruct_plane = DeconstructPlane(Plane=plane)  # -> Origin, XAxis, YAxis, ZAxis
parameter = ClusterInput()
parameter_2 = ClusterInput()
amplitude_2 = Amplitude(Vector=deconstruct_plane.XAxis, Amplitude=amplitude)
amplitude_3 = Amplitude(Vector=deconstruct_plane.YAxis, Amplitude=expression)
division = Division(A=amplitude_2, B=2)
move = Move(Geometry=deconstruct_plane.Origin, Motion=graft(amplitude_2))  # -> Geometry, Transform
addition = Addition(A=division, B=amplitude_3)
vector_xyz = VectorXYZ(XComponent=amplitude_2, YComponent=amplitude_3, ZComponent=0)  # -> Vector, Length
move_2 = Move(Geometry=deconstruct_plane.Origin, Motion=graft(addition))  # -> Geometry, Transform
line = Line(StartPoint=deconstruct_plane.Origin, EndPoint=move.Geometry)
evaluate_curve = EvaluateCurve(Curve=line, Parameter=parameter_2)  # -> Point, Tangent, Angle
line_2 = Line(StartPoint=deconstruct_plane.Origin, EndPoint=move_2.Geometry)
evaluate_curve_2 = EvaluateCurve(Curve=line_2, Parameter=parameter)  # -> Point, Tangent, Angle
line_3 = Line(StartPoint=move.Geometry, EndPoint=move_2.Geometry)
line_4 = Line(StartPoint=evaluate_curve.Point, EndPoint=evaluate_curve_2.Point)
line_5 = Line(StartPoint=evaluate_curve.Point, EndPoint=move_2.Geometry)
construct_plane = ConstructPlane(Origin=move_2.Geometry, XAxis=deconstruct_plane.ZAxis, YAxis=deconstruct_plane.YAxis)
mirror = Mirror(Geometry=[line_4, line_5], Plane=construct_plane)  # -> Geometry, Transform

# ---- group: Bottom girder
curve = Curve(line)

# ---- group: Top girder
line_6 = Line([line_2, line_3])

# ---- group: Diagonaler
line_7 = Line([line_4, mirror.Geometry, line_5])

# ----
line_8 = ClusterOutput(line_7)
curve_2 = ClusterOutput(curve)
line_9 = ClusterOutput(line_6)

# ==== cluster BeamFromLine
domain_start = ClusterInput()
domain_start_2 = ClusterInput()
curve = ClusterInput()
perp_frame = PerpFrame(Curve=curve, Parameter=0)
construct_domain = ConstructDomain(DomainStart=expr("-x/2", domain_start_2), DomainEnd=expr("x/2", domain_start_2))
construct_domain_2 = ConstructDomain(DomainStart=expr("-x/2", domain_start), DomainEnd=expr("x/2", domain_start))
length = Length(Curve=curve)
rectangle = Rectangle(Plane=perp_frame, XSize=construct_domain_2, YSize=construct_domain, Radius=0)  # -> Rectangle, Length
amplitude = Amplitude(Vector=curve, Amplitude=length)
extrude = Extrude(Base=rectangle.Rectangle, Direction=amplitude)
cap_holes = CapHoles(Brep=extrude)
brep = ClusterOutput(cap_holes)

# ==== cluster Cluster
degrees = ClusterInput()
number = ClusterInput()
radians = Radians(Degrees=degrees)
number_2 = ClusterInput()
number_3 = Number(number)
plane = ClusterInput()
number_4 = Number(number_2)
deconstruct_plane = DeconstructPlane(Plane=plane)  # -> Origin, XAxis, YAxis, ZAxis
expression = Expression(l=number_4, a=radians, Expression="tan(a)*(l/2)")
amplitude = Amplitude(Vector=deconstruct_plane.XAxis, Amplitude=number_4)
amplitude_2 = Amplitude(Vector=deconstruct_plane.YAxis, Amplitude=expression)
division = Division(A=amplitude, B=2)
subtraction = Subtraction(A=1, B=number_3)
move = Move(Geometry=deconstruct_plane.Origin, Motion=graft(amplitude))  # -> Geometry, Transform
addition = Addition(A=division, B=amplitude_2)
vector_xyz = VectorXYZ(XComponent=amplitude, YComponent=amplitude_2, ZComponent=0)  # -> Vector, Length
move_2 = Move(Geometry=deconstruct_plane.Origin, Motion=graft(addition))  # -> Geometry, Transform
line = Line(StartPoint=deconstruct_plane.Origin, EndPoint=move_2.Geometry)
evaluate_curve = EvaluateCurve(Curve=reparameterize(line), SplitGirder=[number_3, subtraction])  # -> Point, Tangent, Angle
list_item = ListItem(List=evaluate_curve.Tangent, Index=0, Wrap=True)  # -> Item, Item1
list_item_2 = ListItem(List=evaluate_curve.Point, Index=0, Wrap=True)  # -> Item, Item1
distance = Distance(PointA=deconstruct_plane.Origin, PointB=list_item_2.Item)
deconstruct_vector = DeconstructVector(Vector=list_item.Item)  # -> XComponent, YComponent, ZComponent
line_2 = Line(StartPoint=move.Geometry, EndPoint=move_2.Geometry)
line_3 = Line(StartPoint=deconstruct_plane.Origin, EndPoint=move.Geometry)
multiplication = Multiplication(A=distance, B=deconstruct_vector.XComponent)
amplitude_3 = Amplitude(Vector=deconstruct_plane.XAxis, Amplitude=multiplication)
move_3 = Move(Geometry=deconstruct_plane.Origin, Motion=amplitude_3)  # -> Geometry, Transform
line_4 = Line(StartPoint=list_item_2.Item, EndPoint=move_3.Geometry)
construct_plane = ConstructPlane(Origin=move_2.Geometry, XAxis=deconstruct_plane.ZAxis, YAxis=deconstruct_plane.YAxis)
mirror = Mirror(Geometry=evaluate_curve.Point, Plane=construct_plane)  # -> Geometry, Transform
mirror_2 = Mirror(Geometry=line_4, Plane=construct_plane)  # -> Geometry, Transform
list_item_3 = ListItem(List=mirror.Geometry, Index=0, Wrap=True)  # -> Item, Item1
line_5 = Line(StartPoint=list_item_2.Item1, EndPoint=list_item_3.Item1)

# ---- group: Bottom girder
curve = Curve(line_3)

# ---- group: Top girder
line_6 = Line([line, line_2])

# ---- group: Diagonaler
line_7 = Line([line_4, mirror_2.Geometry, line_5])

# ----
line_8 = ClusterOutput(line_7)
curve_2 = ClusterOutput(curve)
line_9 = ClusterOutput(line_6)

# ==== cluster Cluster_2
degrees = ClusterInput()
lift_factor = ClusterInput()
number = ClusterInput()
radians = Radians(Degrees=degrees)
lenghts = ClusterInput()
number_2 = Number(number)
plane = ClusterInput()
lenghts_2 = Number(lenghts)
deconstruct_plane = DeconstructPlane(Plane=plane)  # -> Origin, XAxis, YAxis, ZAxis
expression = Expression(l=lenghts_2, a=radians, Expression="tan(a)*(l/2)")
amplitude = Amplitude(Vector=deconstruct_plane.XAxis, Amplitude=lenghts_2)
multiplication = Multiplication(A=lenghts_2, Lift_factor=lift_factor)
subtraction = Subtraction(A=1, B=number_2)
amplitude_2 = Amplitude(Vector=deconstruct_plane.YAxis, Amplitude=expression)
division = Division(A=amplitude, B=2)
move = Move(Geometry=deconstruct_plane.Origin, Motion=graft(amplitude))  # -> EndTrussPoint, Transform
addition = Addition(A=division, B=amplitude_2)
vector_xyz = VectorXYZ(XComponent=amplitude, YComponent=amplitude_2, ZComponent=0)  # -> Vector, Length
move_2 = Move(Geometry=deconstruct_plane.Origin, Motion=graft(addition))  # -> TopPoint, Transform
amplitude_3 = Amplitude(Vector=deconstruct_plane.YAxis, Amplitude=expr("-x", multiplication))
line = Line(StartPoint=deconstruct_plane.Origin, EndPoint=move.EndTrussPoint)
line_2 = Line(StartPoint=deconstruct_plane.Origin, EndPoint=move_2.TopPoint)
evaluate_curve = EvaluateCurve(Curve=reparameterize(line_2), SplitGirder=[number_2, subtraction])  # -> Point, Tangent, Angle
list_item = ListItem(List=evaluate_curve.Tangent, Index=0, Wrap=True)  # -> Item, Item1
list_item_2 = ListItem(List=evaluate_curve.Point, Index=0, Wrap=True)  # -> Item, Item1
distance = Distance(PointA=deconstruct_plane.Origin, PointB=list_item_2.Item)
deconstruct_vector = DeconstructVector(Vector=list_item.Item)  # -> XComponent, YComponent, ZComponent
line_3 = Line(StartPoint=move.EndTrussPoint, EndPoint=move_2.TopPoint)
multiplication_2 = Multiplication(A=distance, B=deconstruct_vector.XComponent)
amplitude_4 = Amplitude(Vector=deconstruct_plane.XAxis, Amplitude=multiplication_2)
move_3 = Move(Geometry=line, Motion=graft(amplitude_3))  # -> BottomGirder, Transform
addition_2 = Addition(A=graft(amplitude_3), B=amplitude_4)
move_4 = Move(Geometry=deconstruct_plane.Origin, Motion=addition_2)  # -> Geometry, Transform
line_4 = Line(StartPoint=list_item_2.Item, EndPoint=move_4.Geometry)
construct_plane = ConstructPlane(Origin=move_2.TopPoint, XAxis=deconstruct_plane.ZAxis, YAxis=deconstruct_plane.YAxis)
line_sdl = LineSDL(Start=deconstruct_plane.Origin, Direction=amplitude_3, Length=amplitude_3)  # -> graft(Line)
line_5 = Line(StartPoint=move_4.Geometry, EndPoint=deconstruct_plane.Origin)
mirror = Mirror(Geometry=evaluate_curve.Point, Plane=construct_plane)  # -> Geometry, Transform
merge = Merge(Data1=line_sdl, Data2=line_4, Data3=line_5)
mirror_2 = Mirror(Geometry=merge, Plane=construct_plane)  # -> Geometry, Transform
list_item_3 = ListItem(List=mirror.Geometry, Index=0, Wrap=True)  # -> Item, Item1
line_6 = Line(StartPoint=list_item_2.Item1, EndPoint=list_item_3.Item1)
merge_2 = Merge(Data1=merge, Data2=mirror_2.Geometry, Data3=line_6)

# ---- group: Top girder
line_7 = Line([line_2, line_3])

# ---- group: Bottom girder
curve = Curve(move_3.BottomGirder)

# ---- group: Diagonaler
line_8 = Line(merge_2)

# ----
line_9 = ClusterOutput(line_8)
curve_2 = ClusterOutput(curve)
line_10 = ClusterOutput(line_7)

# ==== cluster WWRoof
degrees = ClusterInput()
radians = Radians(Degrees=degrees)
plane = ClusterInput()
length = ClusterInput()
deconstruct_plane = DeconstructPlane(Plane=plane)  # -> Origin, XAxis, YAxis, ZAxis
expression = Expression(l=length, a=radians, Expression="tan(a)*(l/2)")
amplitude = Amplitude(Vector=deconstruct_plane.YAxis, Amplitude=expression)
amplitude_2 = Amplitude(Vector=deconstruct_plane.XAxis, Amplitude=length)
division = Division(A=amplitude_2, B=2)
addition = Addition(A=division, B=amplitude)
move = Move(Geometry=deconstruct_plane.Origin, Motion=graft(amplitude_2))  # -> Geometry, Transform
move_2 = Move(Geometry=deconstruct_plane.Origin, Motion=graft(addition))  # -> Geometry, Transform
line = Line(StartPoint=deconstruct_plane.Origin, EndPoint=move.Geometry)
line_2 = Line(StartPoint=deconstruct_plane.Origin, EndPoint=move_2.Geometry)
line_3 = Line(StartPoint=move.Geometry, EndPoint=move_2.Geometry)
shatter = Shatter(Curve=reparameterize(line), Parameters=0.5)
list_item = ListItem(List=shatter, Index=0, Wrap=True)
divide_curve = DivideCurve(Curve=list_item, Count="5", Kinks=False)  # -> Points, Tangents, Parameters
dispatch = Dispatch(List=divide_curve.Points, DispatchPattern=[True, False])  # -> ListA, ListB
curve_closest_point = CurveClosestPoint(Point=dispatch.ListB, Curve=line)  # -> Point, Parameter, Distance
point = Point(dispatch.ListB)
evaluate_curve = EvaluateCurve(Curve=line, Parameter=curve_closest_point.Parameter)  # -> Point, Tangent, Angle
distance = Distance(PointA=evaluate_curve.Point, PointB=deconstruct_plane.Origin)
expression_2 = Expression(l=distance, a=graft(radians), Expression="tan(a)*l")
panel = Panel("""1
2""")
list_item_2 = ListItem(List=dispatch.ListA, Index=panel, Wrap=True)
amplitude_3 = Amplitude(Vector=deconstruct_plane.YAxis, Amplitude=expression_2)
move_3 = Move(Geometry=evaluate_curve.Point, Motion=amplitude_3)  # -> Geometry, Transform
weave = Weave(Pattern=[0, 1], Stream0=move_3.Geometry, Stream1=list_item_2, NullGaps=False)
polyline = PolyLine(Vertices=weave, Closed=False)
construct_plane = ConstructPlane(Origin=move_2.Geometry, XAxis=deconstruct_plane.ZAxis, YAxis=deconstruct_plane.YAxis)
explode = Explode(Curve=polyline, Recursive=True)  # -> Segments, Vertices
mirror = Mirror(Geometry=explode.Segments, Plane=construct_plane)  # -> Geometry, Transform
merge = Merge(Data1=explode.Segments, Data2=mirror.Geometry)

# ---- group: Bottom girder
curve = Curve(line)

# ---- group: Top girder
line_4 = Line([line_2, line_3])

# ---- group: Diagonaler
line_5 = Line(merge)

# ----
line_6 = ClusterOutput(line_5)
curve_2 = ClusterOutput(curve)
line_7 = ClusterOutput(line_4)

# ==== cluster Series
step = ClusterInput()
start = ClusterInput()
end = ClusterInput()
expression = Expression(end=end, start=start, step=step, Expression="floor((end-start) / step)")
series = Series(Start=start, Step=step, Count=expr("x+1", expression))
series_2 = ClusterOutput(series)

# ==== cluster TimberCrossSection
material_selection_karamba3d = MaterialSelectionKaramba3D(menu=[dropdown(4), dropdown(15)])
panel = Panel("""36
36
36
48
36
48
61
73
36
48
73""")
panel_2 = Panel("""36
48
148
148
198
198
198
198
223
223
223""")
concatenate = Concatenate(Fragment_A=panel, Fragment_B="x", A=panel_2)
cross_section_karamba3d = CrossSectionKaramba3D(
    FamilyNameOfCrossSection="DefaultCroSec",
    NameOfCrossSection=concatenate,
    Material=material_selection_karamba3d,
    Height_cm=expr("x/10", panel_2),
    UpperFlangeWidth_cm=expr("x/10", panel),
    LowerFlangeWidth_cm=expr("x/10", panel),
    mode="Trapezoid")
cross_section = ClusterOutput(cross_section_karamba3d)

# ==== cluster Cluster_3
second_lvl_index = ClusterInput()
tree = ClusterInput()
tree_statistics = TreeStatistics(Tree=tree)  # -> Paths, Length, Count
deconstruct_path = DeconstructPath(Branch=tree_statistics.Paths)
concatenate = Concatenate(A="{", Fragment_A=deconstruct_path, C=";", second_lvl_index=second_lvl_index, B="}")
replace_paths = ReplacePaths(Data=tree, Search=tree_statistics.Paths, Replace=flatten(concatenate))
data = ClusterOutput(replace_paths)

# ==== cluster InsertPathLevel
tree = ClusterInput()
tree_statistics = TreeStatistics(Tree=tree)  # -> Paths, Length, Count
deconstruct_path = DeconstructPath(Branch=tree_statistics.Paths)
insert_items = InsertItems(List=deconstruct_path, Item="0", Indices="1", Wrap=True)
construct_path = ConstructPath(Indices=insert_items)
replace_paths = ReplacePaths(Data=tree, Search=tree_statistics.Paths, Replace=flatten(construct_path))
data = ClusterOutput(replace_paths)
