# Grasshopper definition 220816_crosec_opt.gh (Grasshopper 1.0.7)
# plug-ins: Karamba3D

pt = Point(Point(0, 0, 3.5))
matselect = MaterialSelectionKaramba3D(menu=[dropdown(2), dropdown(1)])
series = Series(Start=1, Step=1, Count=10)
multiplication = Multiplication(A="1", B=series)
multiplication_2 = Multiplication(A=multiplication, B=0.05)
cross_section = CrossSectionKaramba3D(
    FamilyNameOfCrossSection="DefaultCroSec",
    NameOfCrossSection=multiplication,
    Height_cm=multiplication,
    UpperFlangeWidth_cm=multiplication,
    LowerFlangeWidth_cm=multiplication,
    UpperFlangeThickness_cm=multiplication_2,
    LowerFlangeThickness_cm=multiplication_2,
    SidewallsThickness_cm=multiplication_2,
    FilletRadius_cm=0.6,
    mode="Box")
cross_section_karamba3d = CrossSectionKaramba3D(cross_section)
item = ListItem(List=cross_section_karamba3d, Index=0, Wrap=True)
lng = ListLength(List=cross_section_karamba3d)  # -> expr("x-1", Length)

pt_2 = Point(Point(0, 0, 0))
ln = Line(StartPoint=pt_2, EndPoint=pt)
Z = UnitZ(Factor="-10")  # -> simplify(graft(UnitVector))
X = UnitX(Factor="-5")  # -> simplify(graft(UnitVector))
Y = UnitY(Factor="-1")  # -> simplify(graft(UnitVector))

divide = DivideCurve(Curve=ln, Count=10, Kinks=False)  # -> Points, Tangents, Parameters
shatter = Shatter(Curve=ln, Parameters=divide.Parameters)
multiplication_3 = Multiplication(A="-1", B="5")
multiplication_4 = Multiplication(A="-1", B="5")
X_2 = UnitX(Factor=multiplication_3)  # -> simplify(graft(UnitVector))
Y_2 = UnitY(Factor=multiplication_4)  # -> simplify(graft(UnitVector))
merge = Merge(Data1=Z, Data2=X_2, Data3=Y_2)

explode = Explode(Curve=shatter, Recursive=True)  # -> flatten(Segments), flatten(Vertices)
item_2 = ListItem(List=reverse(flatten(explode.Vertices)), Index=0, Wrap=True)

cullpt = CullDuplicates(Points=explode.Vertices, Tolerance=0.1, CullMode=3)  # -> Points, Indices, Valence
linetobeam = LineToBeamKaramba3D(
    Line=explode.Segments,
    Identifier="Overgurt_test",
    CrossSection=item,
    New=True,
    Remove=True,
    LimitDistance_m=0.005,
    Bending=True,
    SetBucklingLength=True,
    ToPolylineMaxAngle=0.03,
    ToPolylineTolerance=0.01,
    ToPolylineMinEdgeLength=0.25)  # -> Element, Points, Info
loads = LoadsKaramba3D(ForceVector=[Z, X, Y], Local=False, PosInd=item_2, LCase="0", mode="Point")  # -> flatten(Load)
loads_2 = LoadsKaramba3D(ForceVector=merge, Local=False, PosInd=item_2, LCase="1", mode="Point")  # -> flatten(Load)

item_3 = ListItem(List=flatten(cullpt.Points), Index="5", Wrap=True)
item_4 = ListItem(List=flatten(cullpt.Points), Index=0, Wrap=True)

supp = SupportKaramba3D(PosInd=item_4, menu=[buttons(on, on, on, off, off, on)])
supp_2 = SupportKaramba3D(PosInd=item_3, menu=[buttons(on, on, off, off, off, off)])
assemble = AssembleModelKaramba3D(Elem=flatten(linetobeam.Element), Support=flatten([supp, supp_2]), Load=flatten([loads, loads_2]), LimitDistance_m=0.005)  # -> Model, Info, Mass_kg, CenterOfGravity, LoadCaseNames
c_script = CSharpScript(
    m_in=assemble.Model,
    secs=cross_section_karamba3d,
    lc_id="0",
    elemids=["under", "Over"],
    num_iter=lng,
    Reference=["C:\Program Files\Rhino 7\Plug-ins\Karamba\karambaCommon.dll", "C:\Program Files\Rhino 7\Plug-ins\Karamba\karamba.gha"])  # -> out, m_out, utilizations, disp, energy; inputs secs: list, lc_id: Int32, elemids: list of String, num_iter: Int32
# ---------- c_script: C# usings ----------
using System.Linq;

using Karamba;
using Karamba.CrossSections;
using Karamba.Elements;
using Karamba.Geometry;
using Karamba.Models;
using Karamba.Results;
using Karamba.Supports;
# ---------- c_script: C# ----------
    // initialise class level variables
    sups = new List<int>();
    pts = new List<Point3>();
    Node_Elems_Dic = new Dictionary<int, List<int>>();
    BucklingLength_Dic = new Dictionary<int, double>();
    sel_elems = new List<ModelElement>();

    // instantiation of the result variables;
    var k3d = new KarambaCommon.Toolkit();
    List<double> max_disp;
    List<double> out_g;
    List<double> out_comp;
    List<double> utils = new List<double>();
    string message;

    // prep model
    Model mdl = PrepModel(m_in as Model);

    // create point, support, crosec lists
    MakePtList(mdl);
    MakeSupList(mdl);
    MakeCroSecList(mdl, secs);

    // extract only relevant elements
    MakeSelectedElementList(mdl, elemids);

    // node ID - element IDs relation
    MakeNodeElemDic(mdl);

    // calculate buckling length based on the distance between supports
    MakeBucklingLengthDic(mdl);

    // initial settings - karamba
    foreach(ModelElement e in sel_elems)
    {
      // recommended procedure by Karamba
      ModelBeam mb = (ModelBeam) e.Clone();
      mdl.elems[e.ind] = mb;

      // set initial cross-section
      e.crosec = crosecs[0];
    }

    // loop within "num_iter"-input times
    int cnt_iter = 0;
    bool continue_flg = false;
    while (cnt_iter < num_iter)
    {
      continue_flg = false;

      // karamba pre-analysis procedure
      mdl.initMaterialCroSecLists();
      mdl.buildFEModel();

      // execute analysis
      mdl = k3d.Algorithms.AnalyzeThI(mdl, out max_disp, out out_g, out out_comp, out message);

      // loop for each element
      for(int i = 0; i < mdl.elems.Count; i++)
      {
        ModelElement e = mdl.elems[i];

        // recommended procedure by karamba
        e = (ModelBeam) e.Clone();
        mdl.elems[e.ind] = e;

        List<List<List<List<double>>>> model_state = new List<List<List<List<double>>>>();
        BeamForces.solve(mdl, new List<string>{i.ToString()}, "-1", 100, 3, out model_state);

        // extraction of element forces
        double util = CalcElemUtil(e, model_state, lc_id);
        Print("Iter {0}, Max.Util Elem.No.{1} : {2}", cnt_iter, e.ind, util);

        // change cross-section if the element's utilization > 1.0
        if (util > 1.0)
        {
          continue_flg = true;
          int cs_id = crosecs.FindIndex(c => c.name == e.crosec.name);
          if (cs_id == crosecs.Count - 1)
          {
            Print("largest cross-section reached");
            continue;
          }
          e.crosec = crosecs[cs_id + 1];
          Print("new crosec for elem {0}: {1}", e.ind, e.crosec.name);
        }
      }

      if (continue_flg == false)
      {
        Print("Converged before num_iter");
        break;
      }

      if (cnt_iter == num_iter - 1)
      {
        Print("Max iteration reached");
        break;
      }

      cnt_iter += 1;
    } // end of while loop

    // one last analysis before output
    mdl = mdl.Clone();
    mdl.cloneElements();
    mdl.initMaterialCroSecLists();
    mdl.buildFEModel();

    mdl = k3d.Algorithms.AnalyzeThI(mdl, out max_disp, out out_g, out out_comp, out message);

    for(int i = 0; i < mdl.elems.Count;i++)
    {
      ModelElement e = mdl.elems[i];
      List<List<List<List<double>>>> model_state = new List<List<List<List<double>>>>();
      BeamForces.solve(mdl, new List<string>{i.ToString()}, "-1", 100, 3, out model_state);
      double util = CalcElemUtil(e, model_state, lc_id);
      utils.Add(util);
    }

    // output
    m_out = new Karamba.GHopper.Models.GH_Model(mdl);
    utilizations = utils;
    disp = max_disp;
    energy = out_comp;
# ---------- c_script: C# additional code ----------
  //
  // CLASS LEVEL VARIABLES
  //

  Dictionary<int, List<int>> Node_Elems_Dic;
  Dictionary<int, double> BucklingLength_Dic;
  List<Karamba.Elements.ModelElement> sel_elems;
  List<Point3> pts;
  List<int> sups;
  List<CroSec_Beam> crosecs;

  //
  // METHODS
  //

  private Model PrepModel(Model _mdl)
  {
    Model mdl = _mdl;

    if (mdl == null)
    {
      throw new ArgumentException("m_in not type of Karamba Model");
    }

    // avoid side effects
    mdl = mdl.Clone();
    mdl.cloneElements();

    return mdl;
  }

  private void MakeSelectedElementList(Karamba.Models.Model _mdl, List<string> _eids)
  {
    List<ModelElement> tmp_elems = new List<ModelElement>();

    foreach (ModelElement e in _mdl.elems)
    {
      bool sel_flg = false;
      foreach (string s in _eids)
      {
        if (e.id.Contains(s))
        {
          sel_flg = true;
          break;
        }
      }
      if (sel_flg)
      {
        tmp_elems.Add(e);
      }
    }
    sel_elems = tmp_elems;
  }

  private void MakePtList(Model _mdl)
  {
    pts = GetNodes(_mdl);
  }

  private void MakeSupList(Model _mdl)
  {
    sups = _mdl.supports.Select(s => s.node_ind).ToList();
  }

  private void MakeCroSecList(Model _mdl, List<object> _secs)
  {
    crosecs = new List<CroSec_Beam>(_secs.Count);
    foreach (var s in _secs)
    {
      var crosec = s as CroSec_Beam;

      if (crosec == null)
      {
        throw new ArgumentException("Something is wrong with input secs");
      }

      crosecs.Add(crosec);
    }
  }

  private void MakeNodeElemDic(Model _mdl)
  {
    Dictionary<int, List<int>> tmp_dic = new Dictionary<int, List<int>>();

    foreach(ModelElement e in _mdl.elems)
    {
      foreach(int i in e.node_inds)
      {
        if(tmp_dic.ContainsKey(i))
        {
          tmp_dic[i].Add(e.ind);
        }
        else
        {
          tmp_dic.Add(i, new List<int>(){e.ind});
        }
      }
    }

    Node_Elems_Dic = tmp_dic;

  }

  private void MakeBucklingLengthDic(Model _mdl)
  {
    Dictionary<int, double> tmp_dic = new Dictionary<int, double>();

    foreach(ModelElement e in sel_elems)
    {
      double b_len = pts[e.node_inds[0]].DistanceTo(pts[e.node_inds[1]]) * 1000; // length in mm

      foreach(int i in e.node_inds) // n(= 0 or 1): each node at the end of an element
      {
        int nid = i;
        int eid = e.ind;

        bool stop_flg = false;
        while (stop_flg == false)
        {
          if(sups.Contains(nid)) stop_flg = true;
          else
          {
            List<int> otherNode = new List<int>();
            try
            {
              otherNode = Node_Elems_Dic[nid].Where(x => x != eid).ToList();
            }
            catch
            {
              Print("Catch {0]", nid.ToString());
              stop_flg = true;
            }

            if(otherNode.Count == 0) // cantilever case
            {
              b_len *= 2;
              stop_flg = true;
            }

            else
            {
              eid = otherNode[0];
              nid = _mdl.elems[eid].node_inds.Where(x => x != nid).ToList()[0];

              b_len += pts[_mdl.elems[eid].node_inds[0]]
                .DistanceTo(pts[_mdl.elems[eid].node_inds[1]]) * 1000;
            }
          }
        }
      }

      tmp_dic.Add(e.ind, b_len);
    }

    BucklingLength_Dic = tmp_dic;
  }

  private List<Point3> GetNodes(Model _mdl)
  {
    return _mdl.nodes.Select(n => n.pos).ToList();
  }

  private List<double> SortByAbsLarger(double _a, double _b)
  {
    List<double> val;

    if(Math.Abs(_a) < Math.Abs(_b))val = new List<double>(2){_b, _a};
    else val = new List<double>(2){_a, _b};

    return val;
  }

  private double CalcElemUtil(ModelElement _e, List<List<List<List<double>>>> _mdl_state, int _lc_id)
  {
    //
    // NOTE: ONLY APPLICABLE TO CLASS 1 OR 2 SECTION OF HOT FINISHED RHS
    //
    // constants
    int LC = _lc_id; // ### Replaced 200420 ###
    double GAMMA_M0 = 1.05;
    double GAMMA_M1 = 1.05;
    double utnyttelse = 0;

    //
    // 0.EXTRACTION OF ELEMENT FORCES
    //
    List<double> N,My,Mz;
    double N_Ed, My_Ed, Mz_Ed, N_1, N_2, N_3, My_1, My_2, My_3, Mz_1, Mz_2, Mz_3; // in kN, kNm, kNm respectively
    N = SortByAbsLarger(_mdl_state[LC][0][0][0], _mdl_state[LC][0][2][0]);

    My = SortByAbsLarger(_mdl_state[LC][0][0][4], _mdl_state[LC][0][2][4]);
    Mz = SortByAbsLarger(_mdl_state[LC][0][0][5], _mdl_state[LC][0][2][5]);

    N_1 = _mdl_state[LC][0][0][0];
    N_2 = _mdl_state[LC][0][1][0];
    N_3 = _mdl_state[LC][0][2][0];

    My_1 = _mdl_state[LC][0][0][4];
    My_2 = _mdl_state[LC][0][1][4];
    My_3 = _mdl_state[LC][0][2][4];

    Mz_1 = _mdl_state[LC][0][0][5];
    Mz_2 = _mdl_state[LC][0][1][5];
    Mz_3 = _mdl_state[LC][0][2][5];

    N_Ed = Math.Max(Math.Abs(N_1), Math.Max(Math.Abs(N_2), Math.Abs(N_3))); // KN
    My_Ed = Math.Max(Math.Abs(My_1), Math.Max(Math.Abs(My_2), Math.Abs(My_3))); // KNm
    Mz_Ed = Math.Max(Math.Abs(Mz_1), Math.Max(Math.Abs(Mz_2), Math.Abs(Mz_3))); // KNm

    //
    // 1.EXTRACTION OF CROSS-SECTION PROPERTIES
    //

    double h, b, tf, tw, fr, Iyy, Izz, iy, iz, Wyy_el, Wyy_pl, Wzz_el, Wzz_pl, A, E, fy, length_el;

    var CS = _e.crosec as Karamba.CrossSections.CroSec_Box;
    if (CS == null)
    {
      return -999;
    }

    // following from element's cross-section
    h = CS._height * 1000; // height in mm
    b = CS.uf_width * 1000; // width in mm
    tf = CS.uf_thick * 1000; // flange thickness in mm
    tw = CS.w_thick * 1000; // web thickness in mm
    fr = CS.fillet_r * 1000; // inner fillet radius in mm
    Iyy = CS.Iyy * Math.Pow(10, 12); // second moment of inertia in mm4
    Izz = CS.Izz * Math.Pow(10, 12); // second moment of inertia in mm4
    iy = CS.iy * 1000; // radius of gyration in mm
    iz = CS.iz * 1000; // radius of gyration in mm
    Wyy_el = CS.Welz_y_pos * Math.Pow(10, 9); // elastic modulus in mm3
    Wyy_pl = CS.Wply * Math.Pow(10, 9); // plastic modulus in mm3
    Wzz_el = CS.Wely_z_pos * Math.Pow(10, 9); // elastic modulus in mm3 ### UPDATE 200420 it was CS.Welz_y_pos SRY! ###
    Wzz_pl = CS.Wplz * Math.Pow(10, 9); // plastic modulus in mm3
    A = CS.A * Math.Pow(10, 6); // area in mm2

    // following from element's material
    E = CS.material.E() * Math.Pow(10, -3); // E-module in N/mm2
    fy = CS.material.ft() * Math.Pow(10, -3); // yield strength in N/mm2

    // following from element
    length_el = pts[_e.node_inds[0]].DistanceTo(pts[_e.node_inds[1]]) * 1000; // length in mm

    //Print("Lengde_el  = " + length_el.ToString());

    //length_seg = Karamba.Supports.Support[0].DistanceTo(Karamba.Supports.Support[1]);

    //
    // 2.CALCULATE CROSS-SECTION CLASS
    //

    // internal compression part
    double cy_over_tf,cz_over_tw, c_over_t, epsilon ;

    epsilon = Math.Sqrt(235 / fy);

    cy_over_tf = (b - 2 * tw - 2 * fr) / tf;
    cz_over_tw = (h - 2 * tf - 2 * fr) / tw;

    c_over_t = Math.Max(cy_over_tf, cz_over_tw);

    if (c_over_t < 33 * epsilon)
    {
      // class 1
    }
    else if (c_over_t < 38 * epsilon)
    {
      // class 2

    }
    else if (c_over_t < 42 * epsilon)
    {
      // class 3

    }
    else
    {
      // class 4
    }

    //
    // 3.CROSS-SECTIONAL RESISTENCE
    //

    double M_pl_y_Rd, M_pl_z_Rd, N_pl_Rd, n, aw, af, M_N_y_Rd, M_N_z_Rd, alpha, beta, util;

    // bending and axial force

    // the design bending moment resistance of the cross section (M_(pl,Rd))
    // following for class 1 or 2 section
    M_pl_y_Rd = Wyy_pl * fy / GAMMA_M0 * Math.Pow(10, -6); // in kNm
    M_pl_z_Rd = Wzz_pl * fy / GAMMA_M0 * Math.Pow(10, -6); // in kNm

    // the design resistance of the cross section to compression (N_(pl,Rd))
    N_pl_Rd = A * fy / GAMMA_M0 * Math.Pow(10, -3); // in kN
    //Print("N_pl_Rd  = " + N_pl_Rd.ToString());

    // following only for RHS
    n = Math.Abs(N_Ed / N_pl_Rd); // n value as in 6.2.9.1(5)
    aw = Math.Min((A - 2 * b * tf) / A, 0.5);
    af = Math.Min((A - 2 * h * tw) / A, 0.5);

    M_N_y_Rd = Math.Min(M_pl_y_Rd * (1 - n) / (1 - 0.5 * aw), M_pl_y_Rd);
    M_N_z_Rd = Math.Min(M_pl_z_Rd * (1 - n) / (1 - 0.5 * af), M_pl_z_Rd);

    // combined resistance to bi-axial bending and axial force

    alpha = Math.Min(1.66 / (1 - (1.13 * Math.Pow(n, 2))), 6); // alpha as in 6.2.9.1(6)
    beta = alpha;

    util = Math.Pow(My_Ed / M_N_y_Rd, alpha) + Math.Pow(Mz_Ed / M_N_z_Rd, beta);

    // check
    if(util > 1.0)
    {
      Print("utilization >1.0 for cross-sectional resistance: " + util.ToString());
    }
    else
    {
      //Print("utilization for cross-sectional resistance: " + util.ToString());
    }

    //
    // 4.BUCKLING RESISTANCE OF MEMBER (applicable for class 1-2 section, at the moment)
    //
    double N_Rk, My_Rk, Mz_Rk, Lcr_z, lambda_1, lambda_bar_y, lambda_bar_z, alpha2, Phi_y, Phi_z;
    double Chi_y, Chi_z, Chi_LT, Cmy, Cmz, kyy, kzz, kyz, kzy, util661, util662; // psi_y, psi_z,

    N_Rk = A * fy / 1000; // in kN, for Class 1-3 section
    My_Rk = Wyy_pl * fy * Math.Pow(10, -6); // in kNm for Class 1-2 section
    Mz_Rk = Wzz_pl * fy * Math.Pow(10, -6); // in kNm for Class 1-2 section

    // for flexural buckling
    if (BucklingLength_Dic.ContainsKey(_e.ind))
    {
      // // // Print("Global buckling");
      Lcr_z = BucklingLength_Dic[_e.ind];
    }
    else
    {
      Lcr_z = length_el; // assuming buckling length is element length
    }

    lambda_1 = Math.PI * Math.Sqrt(E / fy);
    lambda_bar_y = (Lcr_z / iz) * (1 / lambda_1); // around weak axis
    lambda_bar_z = (Lcr_z / iy) * (1 / lambda_1); // around strong axis

    // // // Print("Lcr  = " + Lcr_z.ToString());

    if(fy < 460) alpha2 = 0.21; // hot finished RHS, alpha value as in Table 6.1
    else alpha2 = 0.13; // hot finished RHS, alpha value as in Table 6.1

    Phi_y = 0.5 * (1 + alpha2 * (lambda_bar_y - 0.2) + Math.Pow(lambda_bar_y, 2));
    Phi_z = 0.5 * (1 + alpha2 * (lambda_bar_z - 0.2) + Math.Pow(lambda_bar_z, 2));

    Chi_y = Math.Min(1 / (Phi_y + Math.Sqrt(Math.Pow(Phi_y, 2) - Math.Pow(lambda_bar_y, 2))), 1.0);
    Chi_z = Math.Min(1 / (Phi_z + Math.Sqrt(Math.Pow(Phi_z, 2) - Math.Pow(lambda_bar_z, 2))), 1.0);
    Chi_LT = 1.0; // no lateral torsional buckling assumed

    /*
    psi_y = My[1] / My[0];
    if (Mz[0] == 0) psi_z = 0;
    else psi_z = Mz[1] / Mz[0];

    Cmy = Math.Max(0.6 + 0.4 * psi_y, 0.4);
    Cmz = Math.Max(0.6 + 0.4 * psi_z, 0.4);
    */

    Cmy = 0.9;
    Cmz = 0.9;

    kyy = Math.Min(
      Cmy * (1 + (lambda_bar_y - 0.2) * (Math.Abs(N_Ed) / (Chi_y * N_Rk / GAMMA_M1))),
      Cmy * (1 + 0.8 * (Math.Abs(N_Ed) / (Chi_y * N_Rk / GAMMA_M1)))
      );

    kzz = Math.Min(
      Cmz * (1 + (lambda_bar_z - 0.2) * (Math.Abs(N_Ed) / (Chi_z * N_Rk / GAMMA_M1))),
      Cmz * (1 + 0.8 * (Math.Abs(N_Ed) / (Chi_z * N_Rk / GAMMA_M1)))
      );

    kyz = 0.6 * kzz;
    kzy = 0.6 * kyy;

    //Print("kyz  = " + kyz.ToString());

    // check with eq(6.61) and eq(6.62)
    util661 = (Math.Abs(N_Ed) / (Chi_y * N_Rk / GAMMA_M1))
      + kyy * (Math.Abs(My_Ed) / (Chi_LT * My_Rk / GAMMA_M1))
      + kyz * (Math.Abs(Mz_Ed) / (Mz_Rk / GAMMA_M1));
    util662 = (Math.Abs(N_Ed) / (Chi_z * N_Rk / GAMMA_M1))
      + kzy * (Math.Abs(My_Ed) / (Chi_LT * My_Rk / GAMMA_M1))
      + kzz * (Math.Abs(Mz_Ed) / (Mz_Rk / GAMMA_M1));

    if (Math.Max(util661, util662) > utnyttelse)
    {
      utnyttelse = Math.Max(util661, util662);
    }

    // Print("utnyttelse  = " + utnyttelse.ToString());

    return utnyttelse;

  }
# ---------- end c_script ----------

analyze = AnalyzeKaramba3D(Model=c_script.m_out)  # -> CalculatedModel, MaximumDisplacement_cm, ResultingForceOfGravity_kN, ElasticEnergy_kNm

panel = Panel(c_script.out)
panel_2 = Panel(c_script.utilizations)
merge_2 = Merge(Data1=analyze.MaximumDisplacement_cm, Data2=analyze.ElasticEnergy_kNm)
modelview = ModelViewKaramba3D(Model=analyze.CalculatedModel, ResultFactors=1, ResultCase=-1)  # -> Model, DeformedMesh, DeformedAxes, DeformedModel
panel_3 = Panel(merge_2)
beamview = BeamViewKaramba3D(Model=modelview.Model)  # -> Model, MeshesOfRenderedBeams, DeformedBeamAxes, LegendColors, LegendTags
legend = Legend(Colour=beamview.LegendColors, Tags=beamview.LegendTags, LegendType=1)
