# Grasshopper definition SHELF2.gh (Grasshopper 1.0.7)
# plug-ins: PTK

localalignment = LocalAlignment(Name="Not Named Alignment", OffsetY=0, OffsetZ=0, RotationAngle=0)
geometry_pipeline = GeometryPipeline(
    GroupByLayer=False,
    GroupByType=False,
    IncludeHidden=True,
    IncludeLocked=True,
    LayerFilter="*",
    NameFilter="*",
    SublayerFiltering=False,
    TypeFilter=4)
rectangular_cross_section = RectangularCrossSection(
    Name="Not Named RectCroSect",
    Width=Slider(100, range=0..100),
    Height=Slider(400, range=0..1000),
    Alignment=localalignment)
unit_y = UnitY(Factor=1)
unit_z = UnitZ(Factor=1)
globalalignfromvector = GlobalAlignFromVector(Vector=unit_z, OffsetWidthY=0, OffsetHeightZ=0)
element = Element(
    Tag="Not Named Element",
    BaseCurve=geometry_pipeline,
    CrossSection=rectangular_cross_section,
    Alignment=globalalignfromvector,
    StructuralPriority=0,
    IntersectionNodes=True)
preview_element = PreviewElement(Elements=element, ShowSimplified=False)
reindeer_assembly = ReindeerAssembly(Elements=flatten(element))
detail_typology = DetailTypology(Mode=Slider(3, range=0..10))
detail_typology_2 = DetailTypology(Mode=Slider(2, range=0..10))
detail_typology_3 = DetailTypology(Mode=Slider(6, range=0..10))
# The Detail Search is finding different details using the mode-component
panel = Panel("L-Detail")
detail_typology_4 = DetailTypology(Mode=Slider(1, range=0..10))
detail_typology_5 = DetailTypology(Mode=Slider(1, range=0..10))
detail_typology_6 = DetailTypology(Mode=Slider(0, range=0..10))
detail_typology_7 = DetailTypology(Mode=Slider(4, range=0..10))
elementlengthrule = ElementLengthRule(MinLength=Slider(2500, range=0..2500), MaxLength=10000000)
detailsearch = DetailSearch(
    Assembly=reindeer_assembly,
    DetailingGroupName="E-Detail_Ortho",
    TrueRules=detail_typology,
    SortingRule=0,
    DetailPreviewColor=ColourSwatch(SwatchColor=RGB(255, 162, 0)),
    PreviewName=False)  # -> Node, Nodeplanes, Elements, UnifiedElementVectors
detailsearch_2 = DetailSearch(
    Assembly=reindeer_assembly,
    DetailingGroupName="Test",
    TrueRules=detail_typology_7,
    SortingRule=0,
    DetailPreviewColor=ColourSwatch(SwatchColor=RGB(255, 0, 217)),
    PreviewName=False)  # -> Node, Nodeplanes, Elements, UnifiedElementVectors
detailsearch_3 = DetailSearch(
    Assembly=reindeer_assembly,
    DetailingGroupName="X-Detail",
    TrueRules=detail_typology_2,
    SortingRule=0,
    DetailPreviewColor=ColourSwatch(SwatchColor=RGB(0, 17, 255)),
    PreviewName=False)  # -> Node, Nodeplanes, Elements, UnifiedElementVectors
detailsearch_4 = DetailSearch(
    Assembly=reindeer_assembly,
    DetailingGroupName="T-Detail_Ortho",
    TrueRules=detail_typology_4,
    FalseRules=detail_typology_3,
    SortingRule=0,
    DetailPreviewColor=ColourSwatch(SwatchColor=RGB(255, 255, 0)),
    PreviewName=False)  # -> Node, Nodeplanes, Elements, UnifiedElementVectors
detailsearch_5 = DetailSearch(
    Assembly=reindeer_assembly,
    DetailingGroupName="T-Detail_Ortho",
    TrueRules=[detail_typology_5, detail_typology_3],
    SortingRule=0,
    DetailPreviewColor=ColourSwatch(SwatchColor=RGB(81, 255, 0)),
    PreviewName=False)  # -> Node, Nodeplanes, Elements, UnifiedElementVectors
detailsearch_6 = DetailSearch(
    Assembly=reindeer_assembly,
    DetailingGroupName=panel,
    TrueRules=detail_typology_6,
    SortingRule=0,
    DetailPreviewColor=ColourSwatch(SwatchColor=RGB(255, 0, 0)),
    PreviewName=False)  # -> Node, Nodeplanes, Elements, UnifiedElementVectors
deconstruct_element = DeconstructElement(Element=detailsearch_2.Elements)  # -> Tag, BaceCurve, PointAtStart, PointAtEnd, CroSecLocalPlane, SimplifiedHeight, SimplifiedWidth, Subelements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
preview_element_2 = PreviewElement(Elements=detailsearch_2.Elements, ShowSimplified=False)
xz_plane = XZPlane(Origin=deconstruct_element.PointAtStart)
xy_plane = XYPlane(Origin=deconstruct_element.PointAtStart)
rotate = Rotate(Geometry=xz_plane, Angle=0.7853981634, Plane=xy_plane)  # -> Geometry, Transform
cut = Cut(Element=detailsearch_2.Elements, CutPlane=rotate.Geometry, FlipPlane=False)  # -> flatten(BTLCut)
btlxsettings = BTLxSettings(ProjectFileName="NoNameProject", FolderLocation="C:\Code\structuralCircle\Scripts\Reindeer", Architect="CSDG-NIKKEN DDL")
processmodel = ProcessModel(Assembly=reindeer_assembly, TimberProcesses=flatten(cut), RunBTLX=Toggle(True), RunNURBS=True, BTLXSetting=btlxsettings)  # -> Stock, Voids, ProcessingSurfaces, ProcessedComponent
