# Grasshopper definition Structural_mapper.gh (Grasshopper 1.0.7)
# plug-ins: PTK

# ----
# Mapping using closest points
profile_srf = Surface()  # disabled
line = Line()  # disabled
profile_srf_2 = Surface()  # disabled
mesh = Mesh()  # disabled
line_2 = Line()  # disabled
merge = Merge(Data1=profile_srf, Data2=profile_srf_2)  # disabled
merge_2 = Merge(Data1=line, Data2=line_2)  # disabled
lng = ListLength(List=profile_srf)  # disabled
len = Length(Curve=merge_2)  # disabled
amoments = AreaMoments(Geometry=merge)  # -> Area, Centroid, Inertia, InertiaError, Secondary, SecondaryError, Gyration; disabled
panel = Panel("1000")  # disabled
cluster = Cluster(init_numbers=amoments.Area, target_max=panel)  # disabled
cluster_2 = Cluster(init_numbers=amoments.Inertia, target_max=panel)  # disabled
cluster_3 = Cluster(init_numbers=len, target_max=panel)  # disabled
entwine = Entwine(Branch00=cluster, Branch01=cluster_2, Branch02=cluster_3, FlattenInputs=True)  # disabled
flip = FlipMatrix(Data=entwine)  # disabled
num2pt = NumbersToPoints(Numbers=flip, Mask=4)  # -> flatten(Points); disabled
split = SplitList(List=num2pt, Index=lng)  # -> ListA, ListB; disabled
pt = Point(split.ListA)  # disabled
pt_2 = Point(split.ListB)  # disabled

# ---- group: Generate random set
# "Supply" bank
number_slider = Slider(100, range=0..1000)  # disabled
dom = ConstructDomain(DomainStart=0, DomainEnd=1)  # disabled
random = Random(Range=Domain(0, 1), Number=number_slider, Seed=5)  # disabled
random_2 = Random(Range=dom, Number=number_slider, Seed=2)  # disabled
random_3 = Random(Range=dom, Number=number_slider, Seed=2)  # disabled
graph = GraphMapper(random_2, x0=0, x1=1, y0=0, y1=1, container_name="Gaussian", factor=0.3311616182, mean=0.3070082068, sdev=0.3750673234)  # disabled
graph_2 = GraphMapper(random_3, x0=0, x1=1, y0=0, y1=1, container_name="Gaussian", factor=0.5366398096, mean=0.5903694034, sdev=0.3804182708)  # disabled
graph_3 = GraphMapper(random, x0=0, x1=1, y0=0, y1=1, container_name="Gaussian", factor=0.7170143127, mean=0.3882903457, sdev=0.2943618894)  # disabled
panel_2 = Panel("10000")  # disabled
panel_3 = Panel("500")  # disabled
multiplication = Multiplication(A=graph_3, B=panel_2)  # disabled
multiplication_2 = Multiplication(A=graph_2, B=panel_3)  # disabled
multiplication_3 = Multiplication(A=graph, B=panel_3)  # disabled
round = Round(Number=multiplication_2)  # -> Nearest, Floor, Ceiling; disabled
round_2 = Round(Number=multiplication_3)  # -> Nearest, Floor, Ceiling; disabled
pt_3 = ConstructPoint(XCoordinate=round.Nearest, YCoordinate=0, ZCoordinate=0)  # disabled
pt_4 = ConstructPoint(XCoordinate=0, YCoordinate=round_2.Nearest, ZCoordinate=0)  # disabled
rec_2pt = Rectangle2Pt(Plane=PlaneXY(0, 0, 0), PointA=pt_3, PointB=pt_4, Radius=0)  # -> Rectangle, Length; disabled
panel_4 = Panel(rec_2pt.Rectangle)  # disabled
boxrec = BoxRectangle(Rectangle=rec_2pt.Rectangle, Height=multiplication)  # disabled
geo = Geometry(boxrec)  # disabled

# ----
# TODO: make universal grouping python:
# - group by minimum element (not average)
# - use multidimensional distance formula
series = Series(Start=0, Step=50, Count=10)  # disabled
pt_5 = ConstructPoint(XCoordinate=0, YCoordinate=0, ZCoordinate=series)  # disabled
number_slider_2 = Slider(2, range=1..10)  # disabled
pt2num = PointsToNumbers(Points=graft(pt_5), Mask=4)  # -> simplify(Numbers); disabled
series_2 = Series(Start=0, Step=250, Count=10)  # disabled
number_slider_3 = Slider(250, range=0..300)  # disabled
pt_6 = ConstructPoint(XCoordinate=0, YCoordinate=0, ZCoordinate=series_2)  # disabled
py_group_by = GhPythonScript(input=simplify(pt2num), tolerance=number_slider_2)  # -> out, simplify(groups), mapping_id, group_min; inputs input: tree; disabled
# ---------- py_group_by: Python ----------
__author__ = "arturbt"
__version__ = "2022.08.02"

import rhinoscriptsyntax as rs
import ghpythonlib.treehelpers as th
import Rhino


groups_list = []


def tree2lol(input_tree):
    # https://developer.rhino3d.com/guides/rhinopython/grasshopper-datatrees-and-python/    lol = []
    lol=[]
    for i in range(input_tree.BranchCount):
        sublist = []
        branchPath = input_tree.Path(i)
        branchList = input_tree.Branch(i)
        for j in range(branchList.Count):
            sublist.append(branchList[j])
        lol.append(sublist)
    return lol

input = tree2lol(input)



# TODO Normalise input



# calculate multi-dimensional distance
# sqrt( (x2-x1)**2 + (y2-y1)**2 + (z2-z1)**2 ) 
for i in input:
    d = ((i[0]-0)**2+(i[1]-0)**2+(i[2]-0)**2)**(0.5)
    groups_list.append(d)


# Turn to Grasshopper tree
# https://developer.rhino3d.com/guides/rhinopython/grasshopper-datatrees-and-python/
groups = th.list_to_tree(groups_list, source=[0,0])
# ---------- end py_group_by ----------
panel_5 = Panel(pt2num)  # disabled
pgroups = PointGroups(Points=pt_6, Distance=number_slider_3)  # -> simplify(Groups), Indices; disabled
panel_6 = Panel(py_group_by.groups)  # disabled
panel_7 = Panel(pgroups.Groups)  # disabled

# ---- group: Actual mapping
number_slider_4 = Slider(97, range=0..300)  # disabled
pt_7 = Point(pt)  # disabled
pt_8 = Point(pt_2)  # disabled
pgroups_2 = PointGroups(Points=pt_7, Distance=number_slider_4)  # -> simplify(Groups), Indices; disabled
division = Division(A=number_slider_4, B=2)  # disabled
avr = Average(Input=pgroups_2.Groups)  # -> flatten(ArithmeticMean); disabled
lng_2 = ListLength(List=pgroups_2.Indices)  # -> flatten(Length); disabled
cps = ClosestPoints(Point=avr, Cloud=pt_8, Count=lng_2)  # -> ClosestPoint, CPIndex, Distance; disabled

# ---- group: Display groups
item = ListItem(List=mesh, Index=pgroups_2.Indices, Wrap=True)  # -> simplify(Item); disabled
tstat = TreeStatistics(Tree=item)  # -> Paths, Length, Count; disabled
division_2 = Division(A=1, B=tstat.Count)  # disabled
series_3 = Series(Start=0, Step=division_2, Count=tstat.Count)  # disabled
hsl = ColourHSL(Alpha=1, Hue=series_3, Saturation=1, Luminance=0.5)  # disabled
preview = CustomPreview(Geometry=item, Material=graft(hsl))  # disabled

# ----
ln = Line(StartPoint=graft(avr), EndPoint=cps.ClosestPoint)  # disabled
sph = Sphere(Base=avr, Radius=division)  # disabled
sph_2 = Sphere(Base=cps.ClosestPoint, Radius=15)  # disabled

# ----
# "Demand" structure
pipeline = GeometryPipeline(
    GroupByLayer=False,
    GroupByType=False,
    IncludeHidden=False,
    IncludeLocked=True,
    LayerFilter="*",
    NameFilter="*",
    SublayerFiltering=True,
    TypeFilter=1073741848)  # disabled
geo_2022_08_01 = Geometry([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])  # disabled
geo_2 = Geometry(pipeline)  # disabled
duo_beams_secondary = Geometry([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])  # disabled
roof_duo_beams_secondary = Geometry([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])  # disabled
tower_beams = Geometry([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])  # disabled
roof_quad_beams = Geometry([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])
short_connectors = Geometry([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])
roof_duo_beams_primary = Geometry([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])
duo_beams = Geometry([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])
quad_beams = Geometry([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])
secondary_beams = Geometry([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])
rafters = Geometry([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])
columns = Geometry([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])
diagonals = Geometry([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])
merge_3 = Merge(Data1=short_connectors, Data2=secondary_beams, Data3=rafters, Data4=columns, Data5=tower_beams, Data6=diagonals)  # -> flatten(Result)

# ----
# "Supply" bank
# TODO: reduce both ends of supply list to remove old connections
generated_beams_ref_hq = Geometry([<brep referenced from the Rhino model> x65])
generated_beams_lq = Geometry([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])
scanned_beams_ref_hq = Geometry([<mesh referenced from the Rhino model> x17])
scanned_beams_lq = Geometry([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])
merge_4 = Merge(Data1=scanned_beams_lq, Data2=generated_beams_lq)
merge_5 = Merge(Data1=scanned_beams_ref_hq, Data2=generated_beams_ref_hq)
yz = YZPlane(Origin=Point(0, 0, 0))
rotate = Rotate(Geometry=merge_4, Angle=-1.570796327, Plane=yz)  # -> Geometry, Transform

merge_6 = Merge(
    Data1=roof_quad_beams,
    Data2=roof_duo_beams_primary,
    Data3=roof_duo_beams_secondary,
    Data4=duo_beams,
    Data5=duo_beams_secondary,
    Data6=quad_beams)  # -> flatten(Result)

# ----
# Add a split of long beams
number_slider_5 = Slider(140, range=70..200)
multiplication_4 = Multiplication(A=number_slider_5, B="100")
geo_3 = Geometry(merge_6)
pt_9 = ConstructPoint(XCoordinate=multiplication_4, YCoordinate=5000, ZCoordinate=0)
bbox = BoundingBox(Content=geo_3, Plane=PlaneXY(0, 0, 0))  # -> Box, Box_2
yz_2 = YZPlane(Origin=pt_9)
box = EvaluateBox(Box=bbox.Box, UParameter=0, VParameter=0, WParameter=0.5)  # -> Plane, Point, Include
box_2 = EvaluateBox(Box=bbox.Box, UParameter=1, VParameter=1, WParameter=0.5)  # -> Plane, Point, Include
pdecon = Deconstruct(Point=box.Point)  # -> XComponent, YComponent, ZComponent
pdecon_2 = Deconstruct(Point=box_2.Point)  # -> XComponent, YComponent, ZComponent
dom_2 = ConstructDomain(DomainStart=pdecon.XComponent, DomainEnd=pdecon_2.XComponent)
inc = Includes(Value=multiplication_4, Domain=dom_2)  # -> Includes, Deviation
dispatch = Dispatch(List=geo_3, DispatchPattern=inc.Includes)  # -> ListA, ListB
sec = BrepPlane(Brep=dispatch.ListA, Plane=yz_2)  # -> simplify(Curves), Points
split_2 = SplitBrep(Brep=graft(dispatch.ListA), Cutter=sec.Curves)  # -> flatten(Result)
geo_4 = Geometry(flatten([split_2, dispatch.ListB]))

merge_7 = Merge(Data1=geo_4, Data2=merge_3)  # -> flatten(Result)

# ----
# TEMP: reduce no. elements
number_slider_6 = Slider(127, range=0..165)
series_4 = Series(Start=Slider(0, range=0..165), Step=1, Count=Slider(10, range=0..50))
culln = CullNth(List=rotate.Geometry, CullFrequency=2)
cull_i = CullIndex(List=merge_3, Indices=series_4, Wrap=True)
item_2 = ListItem(List=merge_7, Index=series_4, Wrap=True)

geo_5 = Geometry(merge_7)

scale = Scale(Geometry=rotate.Geometry, Center=Point(0, 0, 0), Factor="0.1")  # -> Geometry, Transform
scale_2 = Scale(Geometry=geo_5, Center=Point(0, 0, 0), Factor="0.1")  # -> Geometry, Transform

volume = Volume(Geometry=scale_2.Geometry)  # -> Volume, Centroid
Y = UnitY(Factor=150)
move = Move(Geometry=volume.Centroid, Motion=Y)  # -> Geometry, Transform
points = PointList(Points=move.Geometry)

# ----
# Compare volumes
volume_2 = Volume(Geometry=flatten(rotate.Geometry))  # -> Volume, Centroid
volume_3 = Volume(Geometry=flatten(geo_5))  # -> Volume, Centroid
ma = MassAddition(Input=volume_2.Volume)  # -> Result, PartialResults
ma_2 = MassAddition(Input=volume_3.Volume)  # -> Result, PartialResults
division_3 = Division(A=ma_2.Result, B="1000000000")
division_4 = Division(A=ma.Result, B="1000000000")
demand_volume = Panel(division_3)
supply_volume = Panel(division_4)

pipeline_2 = GeometryPipeline(
    GroupByLayer=False,
    GroupByType=False,
    IncludeHidden=True,
    IncludeLocked=True,
    LayerFilter="*",
    NameFilter="*",
    SublayerFiltering=True,
    TypeFilter=4)  # disabled
crv = Curve()  # disabled
number_slider_7 = Slider(120, range=0..1000)  # disabled
la = LocalAlignment(Name="Not Named Alignment", OffsetY=0, OffsetZ=0, RotationAngle=0)  # disabled
number_slider_8 = Slider(2500, range=0..2500)  # disabled
number_slider_9 = Slider(4, range=0..10)  # disabled
panel_8 = Panel("Quad_Test")  # disabled
T = DetailTypology(Mode=number_slider_9)  # disabled
L = ElementLengthRule(MinLength=number_slider_8, MaxLength=10000000)  # disabled
swatch = ColourSwatch(SwatchColor=RGB(255, 0, 217))  # disabled

# ----
# Crossection conversion
# (Reindeer, only timber!)
number_slider_10 = Slider(120, range=0..1000)  # disabled
matstrprop = MaterialStructuralProp(
    Name="Glulam",
    MaterialClass="GL26",
    FMGK=26,
    FT0GK=19,
    FT90GK=0.5,
    FC0GK=23.5,
    FC90GK=2.5,
    FVGK=3.5,
    FRGK=1.2,
    E0GMean=12000,
    E0G05=10000,
    E90GMean=300,
    E90G05=250,
    GGMean=650,
    GG05=542,
    GRGMean=65,
    GRG05=54,
    RhoGK=385,
    RhoGMeam=420)  # disabled
crv_2 = Curve(crv)  # disabled
la_2 = LocalAlignment(Name="Not Named Alignment", OffsetY=0, OffsetZ=0, RotationAngle=0)  # disabled
rectsec = RectangularCrossSection(
    Name="Not Named RectCroSect",
    Width=number_slider_7,
    Height=number_slider_10,
    MaterialProperties=matstrprop,
    Alignment=la_2)  # disabled
Z = UnitZ(Factor=1)  # disabled
Y_2 = UnitY(Factor=1)  # disabled
circrosec = CircularCrossSection(Name="Not Named CirCroSec", Radius=100, MaterialProperties=matstrprop)  # disabled
globalalignfromvector = GlobalAlignFromVector(Vector=Z, OffsetWidthY=0, OffsetHeightZ=0)  # disabled
element = Element(
    Tag="Not Named Element",
    BaseCurve=crv_2,
    CrossSection=rectsec,
    Alignment=globalalignfromvector,
    StructuralPriority=0,
    IntersectionNodes=True)  # disabled
assembly = ReindeerAssembly(Elements=flatten(element))  # disabled
prevelem = PreviewElement(Elements=element, ShowSimplified=False)  # disabled

# ----
# Connection mapping
# (Reindeer, only timber!)
# The Detail Search is finding different details using the mode-component
assembly_2 = Assembly(assembly)  # disabled
number_slider_11 = Slider(3, range=0..10)  # disabled
number_slider_12 = Slider(2, range=0..10)  # disabled
number_slider_13 = Slider(1, range=0..10)  # disabled
number_slider_14 = Slider(2500, range=0..2500)  # disabled
number_slider_15 = Slider(6, range=0..10)  # disabled
number_slider_16 = Slider(1, range=0..10)  # disabled
number_slider_17 = Slider(0, range=0..10)  # disabled
number_slider_18 = Slider(4, range=0..10)  # disabled
panel_9 = Panel("E-Detail_Ortho")  # disabled
panel_10 = Panel("T-Detail_Ortho")  # disabled
panel_11 = Panel("X-Detail")  # disabled
panel_12 = Panel("T-Detail_Ortho")  # disabled
panel_13 = Panel("L-Detail")  # disabled
T_2 = DetailTypology(Mode=number_slider_11)  # disabled
T_3 = DetailTypology(Mode=number_slider_12)  # disabled
T_4 = DetailTypology(Mode=number_slider_15)  # disabled
T_5 = DetailTypology(Mode=number_slider_13)  # disabled
panel_14 = Panel("Test")  # disabled
T_6 = DetailTypology(Mode=number_slider_16)  # disabled
T_7 = DetailTypology(Mode=number_slider_17)  # disabled
T_8 = DetailTypology(Mode=number_slider_18)  # disabled
L_2 = ElementLengthRule(MinLength=number_slider_14, MaxLength=10000000)  # disabled
swatch_2 = ColourSwatch(SwatchColor=RGB(255, 162, 0))  # disabled
swatch_3 = ColourSwatch(SwatchColor=RGB(0, 17, 255))  # disabled
swatch_4 = ColourSwatch(SwatchColor=RGB(255, 255, 0))  # disabled
swatch_5 = ColourSwatch(SwatchColor=RGB(255, 0, 217))  # disabled
swatch_6 = ColourSwatch(SwatchColor=RGB(81, 255, 0))  # disabled
swatch_7 = ColourSwatch(SwatchColor=RGB(255, 0, 0))  # disabled
ds = DetailSearch(
    Assembly=assembly_2,
    DetailingGroupName=panel_14,
    TrueRules=T_8,
    SortingRule=0,
    DetailPreviewColor=swatch_5,
    PreviewName=False)  # -> Node, Nodeplanes, Elements, UnifiedElementVectors; disabled
ds_2 = DetailSearch(
    Assembly=assembly_2,
    DetailingGroupName=panel_9,
    TrueRules=T_2,
    SortingRule=0,
    DetailPreviewColor=swatch_2,
    PreviewName=False)  # -> Node, Nodeplanes, Elements, UnifiedElementVectors; disabled
ds_3 = DetailSearch(
    Assembly=assembly_2,
    DetailingGroupName=panel_11,
    TrueRules=T_3,
    SortingRule=0,
    DetailPreviewColor=swatch_3,
    PreviewName=False)  # -> Node, Nodeplanes, Elements, UnifiedElementVectors; disabled
ds_4 = DetailSearch(
    Assembly=assembly_2,
    DetailingGroupName=panel_10,
    TrueRules=T_5,
    FalseRules=T_4,
    SortingRule=0,
    DetailPreviewColor=swatch_4,
    PreviewName=False)  # -> Node, Nodeplanes, Elements, UnifiedElementVectors; disabled
ds_5 = DetailSearch(
    Assembly=assembly_2,
    DetailingGroupName=panel_12,
    TrueRules=[T_6, T_4],
    SortingRule=0,
    DetailPreviewColor=swatch_6,
    PreviewName=False)  # -> Node, Nodeplanes, Elements, UnifiedElementVectors; disabled
ds_6 = DetailSearch(
    Assembly=assembly_2,
    DetailingGroupName=panel_13,
    TrueRules=T_7,
    SortingRule=0,
    DetailPreviewColor=swatch_7,
    PreviewName=False)  # -> Node, Nodeplanes, Elements, UnifiedElementVectors; disabled

ds_7 = DetailSearch(
    Assembly=assembly_2,
    DetailingGroupName=panel_8,
    TrueRules=T,
    SortingRule=0,
    DetailPreviewColor=swatch,
    PreviewName=False)  # -> Node, Nodeplanes, Elements, UnifiedElementVectors; disabled

# ----
# Connection modeling
# (Reindeer, only timber!)
assembly_3 = Assembly(assembly_2)  # disabled
elem1d = Element1D(ds.Elements)  # disabled
de = DeconstructElement(Element=elem1d)  # -> Tag, BaceCurve, PointAtStart, PointAtEnd, CroSecLocalPlane, SimplifiedHeight, SimplifiedWidth, Subelements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; disabled
prevelem_2 = PreviewElement(Elements=elem1d, ShowSimplified=False)  # disabled
xz = XZPlane(Origin=de.PointAtStart)  # disabled
xy = XYPlane(Origin=de.PointAtStart)  # disabled
rotate_2 = Rotate(Geometry=xz, Angle=0.7853981634, Plane=xy)  # -> Geometry, Transform; disabled
panel_15 = Panel("C:\Code\structuralCircle\Scripts\Reindeer")  # disabled
cut = Cut(Element=elem1d, CutPlane=rotate_2.Geometry, FlipPlane=False)  # -> flatten(BTLCut); disabled
toggle = BooleanToggle(True)  # disabled
X = BTLxSettings(ProjectFileName="NoNameProject", FolderLocation=panel_15, Architect="CSDG-NIKKEN DDL")  # disabled
pm = ProcessModel(Assembly=assembly_3, TimberProcesses=flatten(cut), RunBTLX=toggle, RunNURBS=True, BTLXSetting=X)  # -> Stock, Voids, ProcessingSurfaces, ProcessedComponent; disabled

# ---- group: Distibute in circle
# Rearrange "supply" around for better view
geo_6 = Geometry(scale.Geometry)
geo_7 = Geometry(scale_2.Geometry)
number_slider_19 = Slider(4098, range=0..10000)
bbox_2 = BoundingBox(Content=geo_7, Plane=PlaneXY(0, 0, 0), UnionBox=True)  # -> Box, Box_2
box_3 = EvaluateBox(Box=geo_6, UParameter=0.5, VParameter=0.5, WParameter=0)  # -> Plane, Point, Include
box_4 = EvaluateBox(Box=geo_6, UParameter=0.5, VParameter=0.5, WParameter=1)  # -> Plane, Point, Include
lng_3 = ListLength(List=geo_6)
box_5 = EvaluateBox(Box=bbox_2.Box, UParameter="0", VParameter="0", WParameter=0)  # -> Plane, Point, Include
box_6 = EvaluateBox(Box=bbox_2.Box, UParameter="0.5", VParameter="0.5", WParameter=0)  # -> Plane, Point, Include
dist = Distance(PointA=box_3.Point, PointB=box_4.Point)
dist_2 = Distance(PointA=box_6.Point, PointB=box_5.Point)
pl = PlaneNormal(Origin=Point(0, 0, 0), ZAxis=Vector(0, 0, 1))
sort = SortList(Keys=dist, ValuesA=box_3.Point)  # -> Keys, ValuesA
sort_2 = SortList(Keys=dist, ValuesA=geo_6)  # -> Keys, ValuesA
pdecon_3 = Deconstruct(Point=box_6.Plane)  # -> XComponent, YComponent, ZComponent
orient = Orient(Geometry=sort_2.ValuesA, Source=pl, Target=PlaneXY(0, 0, 0))  # -> Geometry, Transform
pt_10 = ConstructPoint(XCoordinate=pdecon_3.XComponent, YCoordinate=pdecon_3.YComponent, ZCoordinate=0)

# ----
multiplication_5 = Multiplication(A=number_slider_19, B="0.1")

# ---- group: Distibute in circle (continued)
addition = Addition(A=multiplication_5, B=dist_2)
circle = CircleCNR(Center=pt_10, Normal=Vector(0, 0, 1), Radius=addition)
divide = DivideCurve(Curve=circle, Count=lng_3, Kinks=False)  # -> Points, Tangents, Parameters
vec2pt = Vector2Pt(PointA=sort.ValuesA, PointB=divide.Points, Unitize=False)  # -> Vector, Length
move_2 = Move(Geometry=orient.Geometry, Motion=vec2pt.Vector)  # -> Geometry, Transform
points_2 = PointList(Points=divide.Points, Size=Slider(378, range=1..1000))

# ----
# Convert breps to meshes
# TODO: not all meshes are closed. Harder to compute volumes.
geo_8 = Geometry(simplify(graft(move_2.Geometry)))
txt = Text(geo_8)
tmatch = MatchText(Text=txt, RegEx="Mesh*", Case=True)
dispatch_2 = Dispatch(List=geo_8, DispatchPattern=tmatch)  # -> ListA, ListB
debrep = DeconstructBrep(Brep=dispatch_2.ListB)  # -> Faces, Edges, Vertices
mesh_uv = MeshSurface(Surface=debrep.Faces, UCount=1, VCount=1, Overhang=True, Equalize=False)
mjoin = MeshJoin(Meshes=mesh_uv)
weld = WeldMesh(Mesh=mjoin, Angle=3.141592654)
null = NullItem(Item=weld)  # -> NullFlags, InvalidFlags, Description
dispatch_3 = Dispatch(List=weld, DispatchPattern=null.NullFlags)  # -> ListA, ListB
merge_8 = Merge(Data1=dispatch_2.ListA, Data2=dispatch_3.ListB)  # -> flatten(Result)

# ----
# Data Dam
entwine_2 = Entwine(Branch00=scale_2.Geometry, Branch01=merge_8, FlattenInputs=True)  # -> simplify(Result)
dam = DataDam(DataA=entwine_2, BufferDelay=2500000, BufferMode=2)
bang = ExplodeTree(Data=dam)  # -> Branch0, Branch1

# ----
# Input processing
number_slider_20 = Slider(5, range=3..15)
mesh_2 = Mesh(bang.Branch1)
toggle_2 = BooleanToggle(True)
mesh_3 = Mesh(bang.Branch0)
fit_curve_through_cross_sections_cluster = FitCurveThroughCrossSectionsCluster(profile_method_bool=toggle_2, mesh=mesh_2, no_segments=number_slider_20)  # -> profile_srf_2, center_crv_2
fit_curve_through_cross_sections_cluster_2 = FitCurveThroughCrossSectionsCluster(profile_method_bool=toggle_2, mesh=mesh_3, no_segments=number_slider_20)  # -> profile_srf_2, center_crv_2
debrep_2 = DeconstructBrep(Brep=fit_curve_through_cross_sections_cluster.profile_srf_2)  # -> Faces, Edges, Vertices
end = EndPoints(Curve=fit_curve_through_cross_sections_cluster_2.center_crv_2)  # -> Start, End
end_2 = EndPoints(Curve=fit_curve_through_cross_sections_cluster.center_crv_2)  # -> Start, End
srf = Surface(fit_curve_through_cross_sections_cluster_2.profile_srf_2)
debrep_3 = DeconstructBrep(Brep=fit_curve_through_cross_sections_cluster_2.profile_srf_2)  # -> Faces, Edges, Vertices
fcircle = CircleFit(Points=debrep_2.Vertices)  # -> Circle, flatten(Radius), Deviation
srf_2 = Surface(fit_curve_through_cross_sections_cluster.profile_srf_2)
dist_3 = Distance(PointA=end.Start, PointB=end.End)
dist_4 = Distance(PointA=end_2.Start, PointB=end_2.End)
fcircle_2 = CircleFit(Points=debrep_3.Vertices)  # -> Circle, flatten(Radius), Deviation
amoments_2 = AreaMoments(Geometry=srf_2)  # -> Area, Centroid, Inertia, InertiaError, Secondary, SecondaryError, Gyration
amoments_3 = AreaMoments(Geometry=srf)  # -> Area, Centroid, Inertia, InertiaError, Secondary, SecondaryError, Gyration
profile_height_aprox_diameter = Integer(expr("x*2", fcircle.Radius))
line_length = Integer(dist_4)
profile_height_aprox_diameter_2 = Integer(expr("x*2", fcircle_2.Radius))
int = Integer(amoments_2.Area)
int_2 = Integer(amoments_2.Inertia)
line_length_2 = Integer(dist_3)
int_3 = Integer(amoments_3.Area)
int_4 = Integer(amoments_3.Inertia)
entwine_3 = Entwine(
    Branch00=line_length,
    Branch01=int,
    Branch02=mesh_2,
    Branch03=int_2,
    Branch04=fit_curve_through_cross_sections_cluster.center_crv_2,
    Branch05=profile_height_aprox_diameter,
    FlattenInputs=True)
entwine_4 = Entwine(
    Branch00=line_length_2,
    Branch01=int_3,
    Branch02=mesh_3,
    Branch03=int_4,
    Branch04=fit_curve_through_cross_sections_cluster_2.center_crv_2,
    Branch05=profile_height_aprox_diameter_2,
    FlattenInputs=True)
flip_2 = FlipMatrix(Data=entwine_3)  # -> simplify(Data)
flip_3 = FlipMatrix(Data=entwine_4)  # -> simplify(Data)

# ----
# Sort by length
# (descending)
# (ascending)
data = Data(flip_3)
data_2 = Data(flip_2)
tstat_2 = TreeStatistics(Tree=data)  # -> Paths, Length, Count
tstat_3 = TreeStatistics(Tree=data_2)  # -> Paths, Length, Count
item_3 = ListItem(List=data, Index=0, Wrap=True)  # -> flatten(Item)
item_4 = ListItem(List=data_2, Index=0, Wrap=True)  # -> flatten(Item)
series_5 = Series(Start=0, Step=1, Count=tstat_2.Count)
series_6 = Series(Start=0, Step=1, Count=tstat_3.Count)
sort_3 = SortList(Keys=item_3, ValuesA=series_5)  # -> Keys, ValuesA
sort_4 = SortList(Keys=item_4, ValuesA=series_6)  # -> Keys, ValuesA
rev = ReverseList(List=sort_3.ValuesA)
path = ConstructPath(Indices=graft(sort_4.ValuesA))  # -> flatten(Branch)
path_2 = ConstructPath(Indices=graft(rev))  # -> flatten(Branch)
branch = TreeBranch(Tree=data_2, Path=path, MaintainPaths=False)
branch_2 = TreeBranch(Tree=data, Path=path_2, MaintainPaths=False)
supply_tree = Data(branch)
demand_tree = Data(branch_2)

# ----
# Mapping
# Prerequisites: 1. Demand sorted descending
# 2. Supply sorted ascending
# 3. Each list should contain:
#    {0} Length
#    {1} Area
#    {2} Mesh
#    {3} Moment of inertia
#    {4} Line
#    {5} Height
# Instructions: 1. Set 'Plural_assign':
#    - False - only one-to-one mapping
#    - True - multiple 'demand' beams can use the same 'supply' beam.
# 2. for each 'demand' element the algorithm goes through the list of available 'supply' elements until it finds an element of length and area higher or exactly as required.
# 3. If 'plural_assign' is set to True, it will shorten the mapped beam and sort the 'supply' list after that update. If False, the element is removed from the list after mapping.
# TODO: add more parameters for grouping: LCA/transport, etc.
# - allow bigger section or cut to fit.
supply_tree_2 = Data(supply_tree)
demand_tree_2 = Data(demand_tree)
panel_16 = Panel(demand_tree_2)
panel_17 = Panel(supply_tree_2)
python = GhPythonScript(plural_assign=Toggle(True), demand=demand_tree_2, supply=supply_tree_2)  # -> out, mapping_id, logs; inputs demand: tree, supply: tree
# ---------- python: Python ----------
"""Provides a scripting component.
    Inputs:
        demand: testsetste
        y: The y script variable
    Output:
        a: The a output variable"""

__author__ = "arturbt"
__version__ = "2022.07.26"

import rhinoscriptsyntax as rs
import ghpythonlib.treehelpers as th
import Rhino

""" METHODS """ 

def tree2lol(input_tree):
    # https://developer.rhino3d.com/guides/rhinopython/grasshopper-datatrees-and-python/    lol = []
    lol=[]
    for i in range(input_tree.BranchCount):
        sublist = []
        branchPath = input_tree.Path(i)
        branchList = input_tree.Branch(i)
        for j in range(branchList.Count):
            sublist.append(branchList[j])
        lol.append(sublist)
    return lol

def lol2tree(input_lol):
    # https://developer.rhino3d.com/guides/rhinopython/grasshopper-datatrees-and-python/
    tree = th.list_to_tree(input_lol, source=[0,0])
    return tree

""" INPUT """ 

# turn to list of lists
demand_list = tree2lol(demand)  # sorted(tree2lol(demand), key=lambda x: x[0]) 
supply_list = tree2lol(supply)  # sorted(tree2lol(supply), key=lambda x: x[0])

# add original index (branch path) because later we delete some
[demand_list[i].append(i) for i in range(len(demand_list))]
[supply_list[i].append(i) for i in range(len(supply_list))]


""" CALCULATION """ 

mapping_id = []
logs = []

for i in range(len(demand_list)):
    match=False
    for j in range(len(supply_list)):
        if demand_list[i][0] <= supply_list[j][0] and demand_list[i][1] <= supply_list[j][1] and demand_list[i][3] <= supply_list[j][3] and demand_list[i][5] <= supply_list[j][5]:
            match=True
            mapping_id.append(supply_list[j][-1])
            # cut_length.append(supply_list[j][0] - demand_list[i][0])
            break
    if match:
        if plural_assign:
            # shorten the supply element:
            supply_list[j][0] = supply_list[j][0] - demand_list[i][0]
            # sort the supply list
            supply_list = sorted(supply_list, key=lambda x: x[0]) # TODO move this element instead of sorting whole list
            logs.append("#"+str(i)+" Found element #"+str(j)+" and utilized only "+str(supply_list[j][0]/1000)+"m of "+str(demand_list[i][0]/1000)+"m. Demand: L="+str(demand_list[i][0]/1000)+"m, A="+str(demand_list[i][1]/100)+"cm2, I="+str(demand_list[i][3]/10000)+"cm4, H="+str(demand_list[i][5]/10)+"cm.")
        else:
            del supply_list[j]
            logs.append("#"+str(i)+" Found element #"+str(j)+" and utilized fully. Demand: L="+str(demand_list[i][0]/1000)+"m, A="+str(demand_list[i][1]/100)+"cm2, I="+str(demand_list[i][3]/10000)+"cm4, H="+str(demand_list[i][5]/10)+"cm.")
    else:
        mapping_id.append(None)
        logs.append("#"+str(i)+" Not found. Demand: L="+str(demand_list[i][0]/1000)+"m, A="+str(demand_list[i][1]/100)+"cm2, I="+str(demand_list[i][3]/10000)+"cm4, H="+str(demand_list[i][5]/10)+"cm.")

""" OUTPUT """

mapping_id = lol2tree(mapping_id)
# ---------- end python ----------
mapping_index = Number(python.mapping_id)
demand_tree_3 = Data(demand_tree_2)
supply_tree_3 = Data(supply_tree_2)
logs = Text(python.logs)

item_5 = ListItem(List=demand_tree, Index=2, Wrap=True)  # -> flatten(Item)
volume_4 = Volume(Geometry=item_5)  # -> Volume, Centroid
Y_3 = UnitY(Factor=150)
move_3 = Move(Geometry=volume_4.Centroid, Motion=Y_3)  # -> Geometry, Transform
points_3 = PointList(Points=move_3.Geometry)

item_6 = ListItem(List=supply_tree_3, Index=2, Wrap=True)
volume_5 = Volume(Geometry=flatten(item_6))  # -> Volume, Centroid
Y_4 = UnitY(Factor=150)
move_4 = Move(Geometry=volume_5.Centroid, Motion=Y_4)  # -> Geometry, Transform
points_4 = PointList(Points=move_4.Geometry)

# ----
# Iterate
number_slider_21 = Slider(51, range=0..160)
panel_18 = Panel("{0 to ")
addition_2 = Addition(A=number_slider_21, B=1)
concat = Concatenate(FragmentA="{", FragmentB=number_slider_21, FragmentC="}")
split_3 = SplitList(List=logs, Index=addition_2)  # -> ListA, ListB
split_4 = SplitTree(Data=demand_tree_3, Masks=concat)  # -> Positive, Negative
split_5 = SplitList(List=mapping_index, Index=addition_2)  # -> ListA, ListB
item_7 = ListItem(List=split_3.ListA, Index=-1, Wrap=True)
panel_19 = Panel(item_7)

# ----
# Split supply beams by lengths
mapping_index_2 = Number(mapping_index)
demand_tree_4 = Data(demand_tree_3)
supply_tree_4 = Data(supply_tree_3)
flip_4 = FlipMatrix(Data=supply_tree_4)
null_2 = NullItem(Item=mapping_index_2)  # -> NullFlags, InvalidFlags, Description
flip_5 = FlipMatrix(Data=demand_tree_4)
dispatch_4 = Dispatch(List=mapping_index_2, DispatchPattern=null_2.NullFlags)  # -> ListA, simplify(ListB)
bang_2 = ExplodeTree(Data=flip_5)  # -> Branch0, Branch1, Branch2, Branch3, Branch4, Branch5
bang_3 = ExplodeTree(Data=flip_4)  # -> Branch0, Branch1, Branch2, Branch3, Branch4, Branch5
cset = CreateSet(List=dispatch_4.ListB)  # -> simplify(Set), Map
mindex = MemberIndex(Set=dispatch_4.ListB, Member=cset.Set)  # -> simplify(Index), Count
dispatch_5 = Dispatch(List=bang_2.Branch2, DispatchPattern=null_2.NullFlags)  # -> ListA, ListB
dispatch_6 = Dispatch(List=bang_2.Branch0, DispatchPattern=null_2.NullFlags)  # -> ListA, ListB
cull_i_2 = CullIndex(List=bang_3.Branch2, Indices=cset.Set, Wrap=True)
dispatch_7 = Dispatch(List=bang_2.Branch4, DispatchPattern=null_2.NullFlags)  # -> ListA, ListB
item_8 = ListItem(List=bang_3.Branch2, Index=cset.Set, Wrap=True)
item_9 = ListItem(List=bang_3.Branch4, Index=dispatch_4.ListB, Wrap=True)
item_10 = ListItem(List=dispatch_6.ListB, Index=mindex.Index, Wrap=True)  # -> simplify(Item)
py_split_mesh_at_lengths = GhPythonScript(lengths=item_10, meshes=item_8)  # -> simplify(cutGeo), simplify(matchGeo); inputs lengths: tree, meshes: tree of Mesh
# ---------- py_split_mesh_at_lengths: Python ----------
__author__ = "arturbt"
__version__ = "2022.08.14"

import rhinoscriptsyntax as rs
import ghpythonlib.treehelpers as th
from Rhino.Geometry.Intersect.Intersection import MeshMeshFast as meshMeshIntersect
import Rhino
from System.Threading.CancellationToken import CanBeCanceled as cancel
import System

""" METHODS """ 

def tree2lol(input_tree):
    # https://developer.rhino3d.com/guides/rhinopython/grasshopper-datatrees-and-python/    lol = []
    lol=[]
    for i in range(input_tree.BranchCount):
        sublist = []
        branchPath = input_tree.Path(i)
        branchList = input_tree.Branch(i)
        for j in range(branchList.Count):
            sublist.append(branchList[j])
        lol.append(sublist)
    return lol

def lol2tree(input_lol):
    # https://developer.rhino3d.com/guides/rhinopython/grasshopper-datatrees-and-python/
    tree = th.list_to_tree(input_lol, source=[0,0])
    return tree

def SplitAtHeight(mesh, height):
    pt = minPt + rs.CreatePoint(0,0,height)
    pl = rs.PlaneFromNormal(pt, (0,0,1))
    
    pts = [rs.CreatePoint(-10000,-10000,height), rs.CreatePoint(10000,-10000,height), rs.CreatePoint(10000,10000,height), rs.CreatePoint(-10000,10000,height)]
#    pts = [rs.CreatePoint(0,0,height), rs.CreatePoint(1e10,0,height), rs.CreatePoint(1e10,1e10,height), rs.CreatePoint(0,1e10,height)]
    big_mesh = rs.AddMesh(pts, [[0,1,2,3]])
    
    #    split_crv = meshMeshIntersect(mesh, rs.coercemesh(big_mesh))
    result = mesh.Split(rs.coercemesh(big_mesh))
    
    if len(result) == 2:
        # check which part is higher - cut by comparing mid-points
        z1 = (result[0].GetBoundingBox(True).Max.Z-result[0].GetBoundingBox(True).Min.Z)/2+result[0].GetBoundingBox(True).Min.Z
        z2 = (result[1].GetBoundingBox(True).Max.Z-result[1].GetBoundingBox(True).Min.Z)/2+result[1].GetBoundingBox(True).Min.Z
        if z1 < z2:
            lower = result[0]
            higher = result[1]
        else:
            lower = result[1]
            higher = result[0]
    elif len(result) == 1:
        print("BUG! Only one mesh after split.")
        lower = result[0]
        higher = result[0]
    else:
        print("BUG! "+str(len(result))+" instead of two meshes after split.")
        lower_list = []
        higher_list = []
        for r in result:
            # check if higher or lower
            z = (r.GetBoundingBox(True).Max.Z-r.GetBoundingBox(True).Min.Z)/2+r.GetBoundingBox(True).Min.Z
            if z < pt.Z-0.1:
                lower_list.append(r)
            else:
                higher_list.append(r)
        # join the resultant meshes together
        lower = rs.JoinMeshes(lower_list)
        higher = rs.JoinMeshes(higher_list)
        # select mesh by its ID
        lower = rs.coercemesh(lower)
        higher = rs.coercemesh(higher)
    
    return lower, higher


lengths = tree2lol(lengths)
meshes = tree2lol(meshes)[0]
cutGeo = []
matchGeo = []


for i in range(len(meshes)):
    minPt = meshes[i].GetBoundingBox(True).Min
    s=0
    parts = []
    for j in range(len(lengths[i])):
        prev_s = s
        s += lengths[i][j]
        if j == 0:  # first from the bottom has no previous
            lower, higher = SplitAtHeight(meshes[i], s)
        else:
            lower, higher = SplitAtHeight(meshes[i], prev_s)
            lower, higher = SplitAtHeight(higher, s)
        parts.append(lower)
    matchGeo.append(parts)
    
    lower, higher = SplitAtHeight(meshes[i], s)
    cutGeo.append(higher)


cutGeo = lol2tree(cutGeo)
matchGeo = lol2tree(matchGeo)
# ---------- end py_split_mesh_at_lengths ----------
sort_5 = SortList(Keys=flatten(mindex.Index), ValuesA=flatten(py_split_mesh_at_lengths.matchGeo))  # -> Keys, ValuesA
match_geo_original_place = Geometry(sort_5.ValuesA)
unmatched_demand_geo = Data(dispatch_5.ListA)
unmatched_supply_geo = Data(cull_i_2)
matched_demand_geo = Data(dispatch_5.ListB)
cut_geo = Geometry(py_split_mesh_at_lengths.cutGeo)

# ----
# Repositon matched elements
demand_crv = Curve(dispatch_7.ListB)
supply_crv = Curve(item_9)
match_geo = Geometry(sort_5.ValuesA)
bbox_3 = BoundingBox(Content=match_geo, Plane=PlaneXY(0, 0, 0))  # -> Box, Box_2
end_3 = EndPoints(Curve=demand_crv)  # -> Start, End
end_4 = EndPoints(Curve=supply_crv)  # -> Start, End
curvepoint = PointOnCurve(demand_crv, parameter=0.5)
vec2pt_2 = Vector2Pt(PointA=end_3.Start, PointB=end_3.End, Unitize=False)  # -> Vector, Length
boxprop = BoxProperties(Box=bbox_3.Box)  # -> Center, Diagonal, Area, Volume, Degeneracy
vec2pt_3 = Vector2Pt(PointA=end_4.Start, PointB=end_4.End, Unitize=False)  # -> Vector, Length
pl_2 = PlaneNormal(Origin=curvepoint, ZAxis=vec2pt_2.Vector)
pl_3 = PlaneNormal(Origin=boxprop.Center, ZAxis=vec2pt_3.Vector)
orient_2 = Orient(Geometry=match_geo, Source=pl_3, Target=pl_2)  # -> Geometry, Transform
match_geo_desired_place = Geometry(orient_2.Geometry)

scale_3 = Scale(Geometry=bang_2.Branch2, Center=Point(0, 0, 0), Factor="10")  # -> Geometry, Transform
scale_4 = Scale(Geometry=match_geo_original_place, Center=Point(0, 0, 0), Factor="10")  # -> Geometry, Transform
scale_5 = Scale(Geometry=cut_geo, Center=Point(0, 0, 0), Factor="10")  # -> Geometry, Transform
scale_6 = Scale(Geometry=unmatched_supply_geo, Center=Point(0, 0, 0), Factor="10")  # -> Geometry, Transform
scale_7 = Scale(Geometry=matched_demand_geo, Center=Point(0, 0, 0), Factor="10")  # -> Geometry, Transform
scale_8 = Scale(Geometry=match_geo_desired_place, Center=Point(0, 0, 0), Factor="10")  # -> Geometry, Transform
scale_9 = Scale(Geometry=unmatched_demand_geo, Center=Point(0, 0, 0), Factor="10")  # -> Geometry, Transform

# ----
# Visualise results
matching_supply_geo = Data(scale_4.Geometry)
matched_demand_geo_2 = Data(scale_7.Geometry)
unmatched_demand_geo_2 = Data(scale_9.Geometry)
match_geo_desired_place_2 = Data(scale_8.Geometry)
unmatched_supply_geo_2 = Data(scale_6.Geometry)
cuts_geo = Data(scale_5.Geometry)
bbox_4 = BoundingBox(Content=matched_demand_geo_2, Plane=PlaneXY(0, 0, 0))  # -> Box, Box_2
bbox_5 = BoundingBox(Content=matching_supply_geo, Plane=PlaneXY(0, 0, 0))  # -> Box, Box_2
lng_4 = ListLength(List=matching_supply_geo)
boxprop_2 = BoxProperties(Box=bbox_4.Box)  # -> Center, Diagonal, Area, Volume, Degeneracy
boxprop_3 = BoxProperties(Box=bbox_5.Box)  # -> Center, Diagonal, Area, Volume, Degeneracy
ln_2 = Line(StartPoint=boxprop_2.Center, EndPoint=boxprop_3.Center)
random_4 = Random(Range="0.1 to 0.9", Number=lng_4, Seed=2)
hsv = ColourHSV(Alpha="1", Hue=random_4, Saturation=1, Value=1)
swatch_8 = ColourSwatch(SwatchColor=RGBA(194, 21, 21, 15))
swatch_9 = ColourSwatch(SwatchColor=RGBA(255, 226, 176, 98))
preview_2 = CustomPreview(Geometry=matched_demand_geo_2, Material=ColourSwatch(SwatchColor=RGBA(80, 166, 46, 136)))
preview_3 = CustomPreview(Geometry=ln_2, Material=hsv)
preview_4 = CustomPreview(Geometry=matching_supply_geo, Material=hsv)
preview_5 = CustomPreview(Geometry=scale_3.Geometry, Material=swatch_8)
preview_6 = CustomPreview(Geometry=unmatched_supply_geo_2, Material=swatch_8)
preview_7 = CustomPreview(Geometry=cuts_geo, Material=swatch_8)
preview_8 = CustomPreview(Geometry=unmatched_demand_geo_2, Material=ColourSwatch(SwatchColor=RGBA(168, 32, 32, 145)))
preview_9 = CustomPreview(Geometry=match_geo_desired_place_2, Material=hsv)

# ----
# Mapping results
matching_supply_geo_2 = Data(scale_4.Geometry)
unmatched_supply_geo_3 = Data(scale_6.Geometry)
unmatched_demand_geo_3 = Data(scale_9.Geometry)
cuts_geo_2 = Data(scale_5.Geometry)
matched_demand_geo_3 = Data(scale_7.Geometry)
volume_6 = Volume(Geometry=flatten([unmatched_supply_geo_3, cuts_geo_2]))  # -> Volume, Centroid
volume_7 = Volume(Geometry=flatten(matching_supply_geo_2))  # -> Volume, Centroid
volume_8 = Volume(Geometry=unmatched_demand_geo_3)  # -> Volume, Centroid
volume_9 = Volume(Geometry=matched_demand_geo_3)  # -> Volume, Centroid
ma_3 = MassAddition(Input=volume_6.Volume)  # -> Result, PartialResults
ma_4 = MassAddition(Input=volume_7.Volume)  # -> Result, PartialResults
ma_5 = MassAddition(Input=volume_8.Volume)  # -> Result, PartialResults
ma_6 = MassAddition(Input=volume_9.Volume)  # -> Result, PartialResults
division_5 = Division(A=ma_3.Result, B="1000000")
division_6 = Division(A=ma_4.Result, B="1000000")
division_7 = Division(A=ma_5.Result, B="1000000")
division_8 = Division(A=ma_6.Result, B="1000000")
unmatched_supply_volume = Panel(division_5)
unmatched_demand_volume = Panel(division_7)
matched_supply_volume = Panel(division_6)
matched_demand_volume = Panel(division_8)
addition_3 = Addition(A=matched_demand_volume, B=unmatched_demand_volume)
addition_4 = Addition(A=matched_supply_volume, B=unmatched_supply_volume)
division_9 = Division(A=division_8, B=addition_3)
division_10 = Division(A=matched_supply_volume, B=addition_4)
multiplication_6 = Multiplication(A=division_9, B=100)
multiplication_7 = Multiplication(A=division_10, B=100)
covered_demand = Panel(multiplication_6)
stock_utilization = Panel(multiplication_7)

# ==== cluster Cluster
init_numbers = ClusterInput()
init_numbers_2 = Number(init_numbers)
sort = SortList(Keys=init_numbers_2)  # -> Keys, ValuesA
target_max = ClusterInput()
item = ListItem(List=sort.Keys, Index=-1, Wrap=True)
dom = ConstructDomain(DomainStart="0", DomainEnd=target_max)
dom_2 = ConstructDomain(DomainStart="0", DomainEnd=item)
remap = RemapNumbers(Value=init_numbers_2, Source=dom_2, Target=dom)  # -> RemappedNumbers, Clipped
remapped_numbers = ClusterOutput(remap.RemappedNumbers)

# ==== cluster FitCurveThroughCrossSectionsCluster
mesh = ClusterInput()
no_segments = ClusterInput()
mesh_2 = Mesh(mesh)
demesh = DeconstructMesh(Mesh=mesh_2)  # -> Vertices, Faces, Colours, Normals
fline = FitLine(Points=demesh.Vertices)
no_segments_2 = Integer(no_segments)
center_line = Line(flatten(fline))
mesh_3 = Mesh(flatten(mesh_2))
curvepoint = PointOnCurve(center_line, parameter=0.5)
divide = DivideCurve(Curve=center_line, Count=no_segments_2, Kinks=False)  # -> simplify(Points), Tangents, Parameters
len = Length(Curve=center_line)
panel = Panel("""0
-1""")
division = Division(A=len, B=no_segments_2)
cull_i = CullIndex(List=divide.Points, Indices=panel, Wrap=True)  # -> simplify(List)
vec = Vector(center_line)
pl = PlaneNormal(Origin=curvepoint, ZAxis=vec)
pl_2 = PlaneNormal(Origin=cull_i, ZAxis=graft(vec))  # -> simplify(Plane)
sec = MeshPlane(Mesh=graft(mesh_3), Plane=pl_2)
join = JoinCurves(Curves=sec, Preserve=False)  # -> simplify(Curves)
cls = Closed(Curve=join)  # -> Closed, Periodic
dispatch = Dispatch(List=join, DispatchPattern=cls.Closed)  # -> ListA, ListB
trim = TrimTree(Tree=dispatch.ListA, Depth=1)
area = Area(Geometry=dispatch.ListA)  # -> Area, Centroid
pln = Plane(graft(pl))
item = ListItem(List=trim, Index="2", Wrap=True)
item_2 = ListItem(List=trim, Index="1", Wrap=True)
item_3 = ListItem(List=trim, Index="0", Wrap=True)
profile_method_bool = ClusterInput()
trim_2 = TrimTree(Tree=area.Centroid, Depth=1)
rint = RegionIntersection(CurvesA=item_3, CurvesB=item_2, Plane=pln)
profile_method_bool_2 = Boolean(profile_method_bool)
intcrv = Interpolate(Vertices=trim_2, Degree=3, Periodic=False, KnotStyle=1)  # -> flatten(Curve), Length, Domain
runion = RegionUnion(Curves=trim, Plane=pln)  # -> simplify(Result)
rint_2 = RegionIntersection(CurvesA=rint, CurvesB=item, Plane=pln)  # -> simplify(Result)
not = GateNot(A=profile_method_bool_2)
merge = Merge(Data1=rint_2, Data2=runion)
ext = ExtendCurve(Curve=intcrv.Curve, Type=0, Start=division, End=division)
merge_2 = Merge(Data1=profile_method_bool_2, Data2=not)
cull = CullPattern(List=merge, CullPattern=merge_2)  # -> flatten(List)
center_crv = Curve(flatten(ext))
boundary = BoundarySurfaces(Edges=graft(cull), UseTasks=True)
center_crv_2 = ClusterOutput(center_crv)
profile_srf = Surface(flatten(boundary))
profile_srf_2 = ClusterOutput(profile_srf)
