# Grasshopper definition Generator_script.gh (Grasshopper 1.0.7)

path = FilePath("C:\Code\scans3D\Artificial_logs\Dimensions.csv")
file = ReadFile(File=path, PerLineParse=True)
split = TextSplit(Text=file, Separators=",")  # -> simplify(Result)
item = ListItem(List=split, Index="1", Wrap=True)
item_2 = ListItem(List=split, Index="0", Wrap=True)  # -> flatten(Item)
item_3 = ListItem(List=split, Index="2", Wrap=True)
item_4 = ListItem(List=split, Index="3", Wrap=True)
num = Number(item_3)
num_2 = Number(item_4)
num_3 = Number(item)
multiplication = Multiplication(A=num_3, B="10")
null = NullItem(Item=num_2)  # -> NullFlags, InvalidFlags, Description
multiplication_2 = Multiplication(A=num, B="10")
dispatch = Dispatch(List=multiplication_2, DispatchPattern=null.NullFlags)  # -> ListA, ListB
dispatch_2 = Dispatch(List=num_2, DispatchPattern=null.NullFlags)  # -> ListA, ListB
dispatch_3 = Dispatch(List=multiplication, DispatchPattern=null.NullFlags)  # -> ListA, ListB
multiplication_3 = Multiplication(A=dispatch_2.ListB, B="10")
division = Division(A=dispatch.ListA, B=2)
pt = ConstructPoint(XCoordinate=0, YCoordinate=0, ZCoordinate=0)
division_2 = Division(A=multiplication_3, B=2)
division_3 = Division(A=dispatch.ListB, B=2)
circle = CircleCNR(Center=pt, Normal=Vector(0, 0, 1), Radius=division)
neg = Negative(Value=division_3)
neg_2 = Negative(Value=division_2)
Z = UnitZ(Factor=dispatch_3.ListA)
boundary = BoundarySurfaces(Edges=circle)
dom = ConstructDomain(DomainStart=neg, DomainEnd=division_3)
dom_2 = ConstructDomain(DomainStart=neg_2, DomainEnd=division_2)
extr = Extrude(Base=boundary, Direction=Z)
rectangle = Rectangle(Plane=PlaneXY(0, 0, 0), XSize=dom, YSize=dom_2, Radius=0)  # -> Rectangle, Length
boundary_2 = BoundarySurfaces(Edges=rectangle.Rectangle)
boxrec = BoxRectangle(Rectangle=boundary_2, Height=dispatch_3.ListB)
yz = YZPlane(Origin=Point(0, 0, 0))
yz_2 = YZPlane(Origin=Point(0, 0, 0))
rotate = Rotate(Geometry=boxrec, Angle=-1.570796327, Plane=yz)  # -> Geometry, Transform
rotate_2 = Rotate(Geometry=extr, Angle=-1.570796327, Plane=yz_2)  # -> Geometry, Transform
merge = Merge(Data1=rotate_2.Geometry, Data2=rotate.Geometry)
null_2 = NullItem(Item=merge)  # -> NullFlags, InvalidFlags, Description
num_4 = Number(item_2)
dispatch_4 = Dispatch(List=merge, DispatchPattern=null_2.NullFlags)  # -> ListA, flatten(ListB)
lng = ListLength(List=dispatch_4.ListB)
sort = SortList(Keys=flatten(multiplication), ValuesA=num_4)  # -> Keys, ValuesA
sort_2 = SortList(Keys=flatten(multiplication), ValuesA=dispatch_4.ListB)  # -> Keys, ValuesA
series = Series(Start=0, Step=1, Count=lng)
multiplication_4 = Multiplication(A=series, B="500")
X = UnitX(Factor=multiplication_4)
move = Move(Geometry=sort_2.ValuesA, Motion=X)  # -> Geometry, Transform
X_2 = UnitX(Factor="9000")
move_2 = Move(Geometry=move.Geometry, Motion=X_2)  # -> Geometry, Transform
concat = Concatenate(FragmentA="#", FragmentB=sort.ValuesA)
python = GhPythonScript(G=move_2.Geometry, L="Hønefoss_measured_elements", N=concat, B=Toggle(False))  # -> out, a
# ---------- python: Python ----------
"""Provides a scripting component.
    Inputs:
        G: Geometry to bake
        L: Layer name for bake
        B: Bake Activate
    Output:
        a: The a output variable"""
 
__author__ = "ScottD"
__version__ = "2019.08.10"
 
import rhinoscriptsyntax as rs
import scriptcontext
import Rhino
 
 
if B:
 
    print(type(G)) #debug message to Python output
 
    #we obtain the reference in the Rhino doc
    doc_object = scriptcontext.doc.Objects.Find(G)
    print(type(doc_object))
 
    attributes = doc_object.Attributes
    print('the type of attributes is: ' + str(type(attributes)))     #debug message to Python output
 
    geometry = doc_object.Geometry
    print('the type of geometry is: ' + str(type(doc_object)))     #debug message to Python output
 
    #we change the scriptcontext
    scriptcontext.doc = Rhino.RhinoDoc.ActiveDoc
 
    #we add both the geometry and the attributes to the Rhino doc
    rhino_brep = scriptcontext.doc.Objects.Add(geometry, attributes)
    print('the Rhino doc ID is: ' + str(rhino_brep))     #debug message to Python output
 
    #we can for example change the layer in Rhino...
    if not rs.IsLayer(L):
        rs.AddLayer(L)
    rs.ObjectLayer(rhino_brep, L)
 
    rs.ObjectName(rhino_brep, N)
    
    #we put back the original Grasshopper document as default
    scriptcontext.doc = ghdoc
    a = G
# ---------- end python ----------
